# Dynamo custom node GenerateBoundingRectangle.dyf (Dynamo 3.3.0.6316)
# category: Feasibility.Parking
# Generates a rectangle around a planar closed curve, ensuring the curve is completely encapsulated.

# group: Inputs
closedCurve = Input(closedCurve: var)  # supply the closed curve to be encapsulated by the rectangle
degrees = Input(degrees: double = 0)  # the degree of rotation to apply to the bounding rectangle

# group: Create a bounding rectangle around input geometry.
XY = Plane.XY()
code_block = CodeBlock(rotation=degrees) { -rotation; }
rotate = Geometry.Rotate(geometry=closedCurve, basePlane=XY, degrees=code_block)
boundingBox = Geometry.BoundingBox(geometry=rotate)
minPoint = BoundingBox.MinPoint(boundingBox=boundingBox)
maxPoint = BoundingBox.MaxPoint(boundingBox=boundingBox)
byTwoPoints = Vector.ByTwoPoints(start=minPoint, end=maxPoint)
X = Vector.X(vector=byTwoPoints)
Y = Vector.Y(vector=byTwoPoints)
byWidthLength = Rectangle.ByWidthLength(width=X, length=Y)
code_block_2 = CodeBlock { 0.5; }
scale = Vector.Scale(vector=byTwoPoints, scale_factor=code_block_2)
translate = Geometry.Translate(geometry=minPoint, direction=scale)
asVector = Point.AsVector(point=translate)
translate_2 = Geometry.Translate(geometry=byWidthLength, direction=asVector)
XY_2 = Plane.XY()
rotate_2 = Geometry.Rotate(geometry=translate_2, basePlane=XY_2, degrees=degrees)

height = Rectangle.Height(rectangle=byWidthLength)
width = Rectangle.Width(rectangle=byWidthLength)

# group: Outputs
Rectangle = Output(rotate_2)  # the generated bounding rectangle
length = Output(height)  # the length of the rectangle
width_2 = Output(width)  # "width"; the width of the rectangle
