# Dynamo custom node GeneratePerimeterSpots.dyf (Dynamo 3.3.0.6316)
# category: Feasibility.Parking
# Creates parking spots along the perimeter of the input boundary surface.

# group: Inputs.
exclusionZone = Input(exclusionZone: var[]..[] = null)  # surface geometry representing the exclusion zones.
basePlane = Input(basePlane: Autodesk.DesignScript.Geometry.Plane = Autodesk.DesignScript.Geometry.Plane.ByOriginNormal(Autodesk.DesignScript.Geometry.Point.ByCoordinates(), Autodesk.DesignScript.Geometry.Vector.ZAxis()))  # the baseplane that hosts the parking elements.
exclusionZoneAisleWidth = Input(exclusionZoneAisleWidth: double = 7)  # the width of the exclusion zone perimeter aisle.
boundarySurface = Input(boundarySurface: Autodesk.DesignScript.Geometry.Surface)  # the input surface defining the parking area.
convexCornerSpacing = Input(convexCornerSpacing: double = 3)  # the distance of the parking bays from the convex corners.
concaveCornerSpacing = Input(concaveCornerSpacing: double = 4)  # the distance of the parking bays from the concave corners.
bayLength = Input(bayLength: double = 5)  # the length of the vehicular parking bays.
bayWidth = Input(bayWidth: double = 2.5)  # the width of the vehicular parking bays.
convexCornerRadius = Input(convexCornerRadius: double = 5)  # the radial value at the convex corners of the perimeter spot layout.

# group: Get boundary of exclusion zone and project onto parking level plane.
flatten = List.Flatten(list=exclusionZone)
# note: Get the perimeter curves of the surface.
perimeterCurves = Surface.PerimeterCurves(surface=flatten)
# note: Project the perimeter curves onto the plane of the selected Revit level.
pullOntoPlane = Curve.PullOntoPlane(curve=perimeterCurves@L2, plane=basePlane)
# note: Join the projected curves into one polycurve.
byJoinedCurves = PolyCurve.ByJoinedCurves(curves=pullOntoPlane)

# group: Offset the exclusion zones by the aisle with and combine into one surface.
offsetMany = Curve.OffsetMany(curve=byJoinedCurves, signedDistance=exclusionZoneAisleWidth)
byPatch = Surface.ByPatch(closedCurve=offsetMany)
byUnion = Surface.ByUnion(surfaces=byPatch)

# group: Get boundary curves and project onto parking level plane.
flatten_2 = List.Flatten(list=boundarySurface)
# note: Get the perimeter curves of the surface.
perimeterCurves_2 = Surface.PerimeterCurves(surface=flatten_2)
# note: Project the perimeter curves onto the plane of the selected Revit level.
pullOntoPlane_2 = Curve.PullOntoPlane(curve=perimeterCurves_2@L1, plane=basePlane)

# group: Get boundary curve vectors.
code_block = CodeBlock { [0,1]; }
# note: Get the start and end points of the projected curves.
pointAtParameter = Curve.PointAtParameter(curve=pullOntoPlane_2, param=code_block, lacing=CrossProduct)
# note: Create polycurves connecting the paired start and end points.
byPoints = PolyCurve.ByPoints(points=pointAtParameter)
# note: Get the lines from the polycurves.
curves = PolyCurve.Curves(polyCurve=byPoints)
# note: Flatten the line list.
flatten_3 = List.Flatten(list=curves)
# note: Get the vectors (directions) of the lines. These vectors will be used to work out the corner angles of the parking area.
direction = Line.Direction(line=flatten_3)

# group: Pair the boundary curves at each corner.
code_block_2 = CodeBlock { -1; }
# note: Shift the position of all the lines by -1 to allow for pairing of adjacent lines.
shiftIndices = List.ShiftIndices(list=flatten_3, amount=code_block_2)
# note: Reverse the direction of the curves.
reverse = Curve.Reverse(curve=shiftIndices)
# note: Combine the original line list with the shifted and reversed line list.
list_create = List.Create(item0=reverse, item1=flatten_3)
# note: Pair the lines in the first and second list. The paired lines will be used to create the perimeter parking setout points.
transpose = List.Transpose(lists=list_create)

# group: Get corner angles of parking bay boundaries.
code_block_3 = CodeBlock { -1; }
# note: Shift the position of all the vectors by -1.
shiftIndices_2 = List.ShiftIndices(list=direction, amount=code_block_3)
# note: Reverse the direction of the shifted vectors.
reverse_2 = Vector.Reverse(vector=shiftIndices_2)
# note: Vector along the Z Axis.
ZAxis = Vector.ZAxis()
# note: We calculate the angles between a set of original vectors and their manipulated versions (shifted and reversed), using the Z vector as our rotation axis. These generated angles provide us with the corner angles of the parking area.
angleAboutAxis = Vector.AngleAboutAxis(vector=reverse_2, otherVector=direction, rotationAxis=ZAxis)

# group: Sort the paired convex and concave corner lines.
# note: In this step, we generate a true/false boolean list. This list will be instrumental in sorting lines, corner points, and angles for both concave and convex corners. Angles less than 180 degrees are labeled as 'false', while those greater than 180 degrees are labeled as 'true'.
code_block_4 = CodeBlock(corner_angle=angleAboutAxis) { corner_angle > 180; }
# note: By utilizing the true/false boolean list, we are able to distinguish between the paired convex and concave corner boundary lines in the parking area. Lines in the 'in' list represent convex corner lines, while those in the 'out' list signify concave corner lines.
filterByBoolMask = List.FilterByBoolMask(list=transpose, mask=code_block_4)

# group: Sort convex and concave corner points.
# note: Here we get the corner points of the parking area.
endPoint = Curve.EndPoint(curve=flatten_3)
# note: By utilizing the above true/false boolean list, we are able to distinguish between convex and concave corner points in the parking area. Angles in the 'in' list represent convex corner points, while those in the 'out' list signify concave corner points.
filterByBoolMask_2 = List.FilterByBoolMask(list=endPoint, mask=code_block_4)

# group: Create convex corner setout points.
# note: Calculate the curve parameter at the convex corner by using the sorted convex corner points on the corresponding sorted convex lines.
parameterAtPoint = Curve.ParameterAtPoint(curve=filterByBoolMask.in, point=filterByBoolMask_2.in)
code_block_5 = CodeBlock { false; }
# note: In this step, we establish the setout points for the parking bay around the convex corner. We do this by using the 'convex corner spacing' parameter as the chord length input.
pointAtChordLength = Curve.PointAtChordLength(curve=filterByBoolMask.in, chordLength=convexCornerSpacing, parameterLocation=parameterAtPoint, forward=code_block_5)

# group: Sort convex and concave corner angles.
# note: By utilizing the above true/false boolean list, we are able to distinguish between convex and concave angles in the parking area. Angles in the 'in' list represent convex corners, while those in the 'out' list signify concave corners.
filterByBoolMask_3 = List.FilterByBoolMask(list=angleAboutAxis, mask=code_block_4)

# group: Create concave corner setout points.
code_block_6 = CodeBlock(concave_angle=filterByBoolMask_3.out, concave_corner_spacing=concaveCornerSpacing, parking_bay_length=bayLength)
# ---------- code_block_6.designscript (20 lines) ----------
//calculate distance for concave corner setout points.
	//calculate the equal isosceles angle.
	equal_angle = (180 - concave_angle) / 2;

	//calculate length of side of isoceles triangle.
	side_length =
	concave_corner_spacing * DSCore.Math.Sin(equal_angle) /
	DSCore.Math.Sin(concave_angle);

	//calculate the hypotenuse length of parking bay side triangle.
	hypotenuse_length =
	parking_bay_length / DSCore.Math.Cos(90 - concave_angle);

	//calculate the base length of parking bay side triangle.
	base_length =
	parking_bay_length * DSCore.Math.Tan(90 - concave_angle);

	//concave corner setout distance.
	concave_corner_distance =
	side_length + hypotenuse_length + base_length;
# ----------------------------------------
# note: Calculate the curve parameter at the concave corner by using the sorted convex corner points on the corresponding sorted concave lines.
parameterAtPoint_2 = Curve.ParameterAtPoint(curve=filterByBoolMask.out, point=filterByBoolMask_2.out)
code_block_7 = CodeBlock { false; }
# note: In this step, we establish the setout points for the parking bay around the concave corner. We do this by using the 'concave corner distance' value generated below as the chord length input.
pointAtChordLength_2 = Curve.PointAtChordLength(curve=filterByBoolMask.out, chordLength=code_block_6.concave_corner_distance, parameterLocation=parameterAtPoint_2, forward=code_block_7)

# group: Pair setout points for the perimeter parking setout lines.
# note: Combine the convex and concave corner setout points in one list.
join = List.Join(list0=pointAtChordLength, list1=pointAtChordLength_2)
code_block_8 = CodeBlock { true; }
# note: In this step, we determine the indices of the convex corners from the boolean list. We then use these indices to arrange the perimeter parking bay setout points following the original sequence of the input parking layout geometry
allIndicesOf = List.AllIndicesOf(list=code_block_4, item=code_block_8)
code_block_9 = CodeBlock { false; }
# note: In this step, we determine the indices of the concave corners from the boolean list. We then use these indices to arrange the perimeter parking bay setout points following the original sequence of the input parking layout geometry
allIndicesOf_2 = List.AllIndicesOf(list=code_block_4, item=code_block_9)
# note: Combine the convex and concave corner indices in one list.
join_2 = List.Join(list0=allIndicesOf, list1=allIndicesOf_2)
# note: Sort the convex and concave corner setout points using the indices.
sortByKey = List.SortByKey(list=join, keys=join_2)
# note: Reverse the order of the paired setout points.
reverse_3 = List.Reverse(list=sortByKey.sortedList@L2)
flatten_4 = List.Flatten(list=reverse_3)
code_block_10 = CodeBlock { -1; }
# note: Shift the list of setout points by -1. This allows for the construction of a setout line that serves as a reference for setting out the perimeter parking bays.
shiftIndices_3 = List.ShiftIndices(list=flatten_4, amount=code_block_10)
code_block_11 = CodeBlock { 2; }
# note: Pair the setout points and create the setout lines.
chop = List.Chop(list=shiftIndices_3, lengths=code_block_11)

# group: Create the center points of the perimeter parking bays.
# note: Create the perimeter parking bay curves.
byPoints_2 = PolyCurve.ByPoints(points=chop)
# note: Get the length of the perimeter parking bay curves.
length = Curve.Length(curve=byPoints_2)
# note: To divide the perimeter parking setout curves into the required number of parking spots.
code_block_12 = CodeBlock(setout_line_length=length, parking_bay_width=bayWidth)
# ---------- code_block_12.designscript (7 lines) ----------
//work out the number of perimeter parking spots per setout curve.
perimeter_parking_number =
(setout_line_length / parking_bay_width);

//the required number of perimeter parking setout points.
perimeter_parking_point_number =
perimeter_parking_number + 1;
# ----------------------------------------
# note: Round the perimeter division numbers to a lower integer value.
floor = Math.Floor(number=code_block_12.perimeter_parking_point_number)
# note: Create parameters to split the perimeter parking bay setout curves.
code_block_13 = CodeBlock(point_number=floor) { 0..1..#point_number; }
# note: Split the perimeter setout curves with the generated parameters.
splitByParameter = Curve.SplitByParameter(curve=byPoints_2, parameters=code_block_13)
code_block_14 = CodeBlock { 0.5; }
# note: Here we get the center points of the curves. They will be translated (moved) and used as the center points of the perimeter parking bays.
pointAtParameter_2 = Curve.PointAtParameter(curve=splitByParameter, param=code_block_14)
code_block_15 = CodeBlock { 0.5; }
# note: Create a coordinate system at the center of the perimeter setout curves.
coordinateSystemAtParameter = Curve.CoordinateSystemAtParameter(curve=byPoints_2, param=code_block_15)
# note: Get the X vector of the coordinate system for translating (moving) the perimeter parking center points.
XAxis = CoordinateSystem.XAxis(coordinateSystem=coordinateSystemAtParameter)
# note: Flip the direction of the X vector.
reverse_4 = Vector.Reverse(vector=XAxis)
# note: Here, we divide the parking bay length by two and use the resulting value to translate (move) the points.
code_block_16 = CodeBlock(parking_bay_length=bayLength) { parking_bay_length/2; }
# note: Move the points to create the center of the perimeter parking bays.
translate = Geometry.Translate(geometry=pointAtParameter_2, direction=reverse_4, distance=code_block_16)

# group: Add the perimeter parking bay rectangles.
flatten_5 = List.Flatten(list=exclusionZone)
# note: Return a surface not intersecting with the parking surface if the exclusion zone input is null.
code_block_17 = CodeBlock(exclusion_zone=flatten_5, plane=basePlane, projected_exclusion_zone=byUnion)
# ---------- code_block_17.designscript (7 lines) ----------
exclusion_zone == null?
Autodesk.Surface.ByPatch(
	Autodesk.Geometry.Translate(
		Rectangle.ByWidthLength(plane, 500,500), Vector.ZAxis(), 500
			)
			):
projected_exclusion_zone;
# ----------------------------------------
byUnion_2 = Surface.ByUnion(surfaces=code_block_17)
# note: Create planes to host perimeter parking bay rectangles.
byOriginNormal = Plane.ByOriginNormal(origin=translate)
# note: Get the widths of the perimeter bays from the split perimeter curves.
length_2 = Curve.Length(curve=splitByParameter)
# note: Create the perimeter parking bay rectangles.
byWidthLength = Rectangle.ByWidthLength(plane=byOriginNormal, width=length_2, length=bayLength)
XAxis_2 = Vector.XAxis()
# note: Get the lines from the perimter setout curves.
curves_2 = PolyCurve.Curves(polyCurve=byPoints_2)
# note: Get the vectors of the lines.
direction_2 = Line.Direction(line=curves_2)
flatten_6 = List.Flatten(list=direction_2)
ZAxis_2 = Vector.ZAxis()
# note: Generate the rotation angles for the perimeter parking bays.
angleAboutAxis_2 = Vector.AngleAboutAxis(vector=XAxis_2, otherVector=flatten_6, rotationAxis=ZAxis_2)
# note: Rotate the perimeter parking bays.
rotate = Geometry.Rotate(geometry=byWidthLength@L2, basePlane=byOriginNormal@L2, degrees=angleAboutAxis_2@L1)
flatten_7 = List.Flatten(list=rotate)
# note: Sort the perimeter parking bays that do not intersect with the exclusion zone aisles.
filterByBoolMask_4 = Python(IN[0]=byUnion_2, IN[1]=flatten_7)  # "List.FilterByBoolMask"; CPython3
# ---------- filterByBoolMask_4.python (17 lines) ----------
# Load the Python Standard and DesignScript Libraries
import sys
import clr
from Autodesk.DesignScript.Geometry import *


# Inputs
filtering_surface = IN[0]
parking_spots = IN[1]

# Filter the parking spots with the exclusion zone surfaces.
filtered_spots = []
for parking_spot in parking_spots:
    if Geometry.DoesIntersect(filtering_surface, parking_spot) == False:
        filtered_spots.append(parking_spot)

OUT = filtered_spots
# ----------------------------------------
count = List.Count(list=flatten)

# group: Workout angles for rotation of the placed internal parking spots.
curves_3 = PolyCurve.Curves(polyCurve=filterByBoolMask_4)
code_block_18 = CodeBlock { 0; }
getItemAtIndex = List.GetItemAtIndex(list=curves_3@L2, index=code_block_18)
direction_3 = Line.Direction(line=getItemAtIndex)
reverse_5 = Vector.Reverse(vector=direction_3)
code_block_19 = CodeBlock { Vector.YAxis(); }
code_block_20 = CodeBlock { Vector.ZAxis(); }
angleAboutAxis_3 = Vector.AngleAboutAxis(vector=reverse_5, otherVector=code_block_19, rotationAxis=code_block_20)

# group: Create new surface pulled onto level.
byJoinedCurves_2 = PolyCurve.ByJoinedCurves(curves=pullOntoPlane_2)
byPatch_2 = Surface.ByPatch(closedCurve=byJoinedCurves_2)

# group: Combine the exclusion zone surfaces into one surface.
byPatch_3 = Surface.ByPatch(closedCurve=byJoinedCurves)
byUnion_3 = Surface.ByUnion(surfaces=byPatch_3)

# group: Create perimeter green surfaces.
byJoinedCurves_3 = PolyCurve.ByJoinedCurves(curves=pullOntoPlane_2)
code_block_21 = CodeBlock(parking_bay_length=bayLength) { -parking_bay_length; }
# note: Offset the parking lot's perimeter boundary inwards.
offsetMany_2 = Curve.OffsetMany(curve=byJoinedCurves_3, signedDistance=code_block_21)
code_block_22 = CodeBlock { false; }
# note: Fillet the convex corners.
fillet = PolyCurve.Fillet(polyCurve=offsetMany_2, radius=convexCornerRadius, clockwise_corners=code_block_22)
# note: The parking lot surface minus the depth of the perimeter parking bays.
byPatch_4 = Surface.ByPatch(closedCurve=fillet)
# note: Subract the internal surface from the overall parking lot surface.
difference = Surface.Difference(surface=byPatch_2, others=byPatch_4)
byPatch_5 = Surface.ByPatch(closedCurve=filterByBoolMask_4)
flatten_8 = List.Flatten(list=byPatch_5)
# note: Subract the perimeter spots from the perimeter surface.
difference_2 = Surface.Difference(surface=difference, others=flatten_8)
flatten_9 = List.Flatten(list=exclusionZone)
# note: Return a surface not intersecting with the parking surface if the exclusion zone input is null.
code_block_23 = CodeBlock(exclusion_zone=flatten_9, plane=basePlane, projected_exclusion_zone=byUnion_3)  # same code as code_block_17
# note: Subract the exclusion zones from the perimeter surface. In case the exclusion zones intersect with the perimeter of the parking layout.
difference_3 = Surface.Difference(surface=difference_2, others=code_block_23)

# group: Calculate the total area of the parking lot.
area = Surface.Area(surface=boundarySurface)
convert_by_units = DynamoUnitConvert(area, MeasurementType="autodesk.unit.quantity:length-1.0.4", FromConversion="autodesk.unit.unit:centimeters-1.0.1", ToConversion="autodesk.unit.unit:centimeters-1.0.1")
floor_2 = Math.Floor(number=convert_by_units)
code_block_24 = CodeBlock { 0; }
getItemAtIndex_2 = List.GetItemAtIndex(list=floor_2, index=code_block_24)
# note: The total parking area.
out_parking_lot_area = Watch(getItemAtIndex_2)  # graph output

# group: Outputs.
rotationAngle = Output(angleAboutAxis_3)  # the rotation angle for the parking bays loaded into the Revit model.
internalSurface = Output(byPatch_4)  # surface depicting an offset from the complete parking layout, equivalent to the length of the parking spots.
greenSurface = Output(difference_3)  # the surface representing areas with no parking at the perimeter.
parkingSpots = Output(filterByBoolMask_4)  # rectangles representing the parking spots.
parkingArea = Output(out_parking_lot_area)  # the area of the parking layout in m².
perimeterCurves_3 = Output(pullOntoPlane_2)  # "perimeterCurves"; the perimeter curves of the parking layout.
