# Dynamo custom node InternalandRoadwaySurfaces.dyf (Dynamo 3.3.0.6316)
# category: Feasibility.Parking
# Creates the internal parking and roadway surfaces.

# group: Inputs
boundaryCurve = Input(boundaryCurve: Autodesk.DesignScript.Geometry.PolyCurve)  # a polycurve representing the boundary of the site area.
bayLength = Input(bayLength: double = 5)  # the length of the vehicular parking bays.
perimeterAisleWidth = Input(perimeterAisleWidth: double = 7)  # the width of the perimeter aisle all round the parking layout.
concaveCornerRadius = Input(concaveCornerRadius: double = 3.5)  # The vehicle turning radius at the concave corners of the perimeter aisle.
convexCornerRadius = Input(convexCornerRadius: double = 5)  # The vehicle turning radius at the convex corners of the perimeter aisle.

# group: Create internal parking area and perimeter roadway surfaces.
# note: Here we add the aisle width and parking bay length to offset the external boundary of the parking area.
code_block = CodeBlock(parking_bay_length=bayLength, aisle_width=perimeterAisleWidth) { -(parking_bay_length + aisle_width); }
# note: Offset the perimeter boundary to create the internal surface for the internal parking spots. Use a while loop to keep one single curve loop if the user offset results in multiple loops.
python_script = Python(IN[0]=boundaryCurve, IN[1]=code_block)  # CPython3
# ---------- python_script.python (33 lines) ----------
# Import the required libraries.
import clr
clr.AddReference('ProtoGeometry')
from Autodesk.DesignScript.Geometry import *

# Inputs.
site_curve = IN[0]
offset_distance = IN[1]

# Offset the boundary curve.
# Return the polycurve to singular curve if the user input offset returns two curves.
current_offset = offset_distance
increment_value = 0.1
max_attempts = 1000
attempts = 0

while attempts < max_attempts:
    offset_curve = Curve.OffsetMany(site_curve, current_offset, Vector.ZAxis())
    
    # Check if the offset curve list has more than one curve loop:
    if len(offset_curve) == 1:
        returned_curve = offset_curve
        break
    else:
        # Reduce the offset and try again
        current_offset += increment_value  # Adding to the negative value
        attempts += 1

# Check if a valid offset curve was found:
if 'returned_curve' not in locals():
    raise Exception("Could not reduce the curve offset to one loop after multiple attempts")

OUT = returned_curve
# ----------------------------------------
# note: Fillet (round) the convex corners of the internal parking surface with the vehicle turning radii parameter. Return the original polycurve if the fillet cannot be achieved.
python_script_2 = Python(IN[0]=python_script, IN[1]=concaveCornerRadius, IN[2]=convexCornerRadius)  # CPython3
# ---------- python_script_2.python (25 lines) ----------
# Import the required libraries.
import clr
clr.AddReference('ProtoGeometry')
from Autodesk.DesignScript.Geometry import *

# Inputs.
polycurve = IN[0]
internal_fillet_radius = IN[1]
external_fillet_radius = IN[2]

# Add internal fillet to polycurve. Return original if unsuccessful.
try:
    internal_fillet_curve = PolyCurve.Fillet(polycurve[0], internal_fillet_radius, False)
except:
    internal_fillet_curve = polycurve


# Add external fillet to polycurve. Return internal fillet curve if unsuccessful.   
try:
    external_fillet_curve = PolyCurve.Fillet(internal_fillet_curve, external_fillet_radius, True)
except:
    external_fillet_curve = internal_fillet_curve


OUT = external_fillet_curve
# ----------------------------------------
# note: Create the internal parking surface.
byPatch = Surface.ByPatch(closedCurve=python_script_2)
# note: Create the full parking layout surface.
byPatch_2 = Surface.ByPatch(closedCurve=boundaryCurve)
# note: Create the perimeter roadway surface.
difference = Surface.Difference(surface=byPatch_2, others=byPatch)

# group: Ouputs
internalParkingSurface = Output(byPatch)  # the parking lot surface minus the depth of the perimeter parking bays and perimeter aisle.
perimeterRoadwaySurface = Output(difference)  # a surface covering the length of the perimeter spots and the width of the perimeter aisle.
internalBoundaryCurve = Output(python_script)  # the boundary curve of the internal parking area surface.
