# Dynamo graph Nodes_ExclusionZoneSpots.dyn (Dynamo 3.3.0.6316)

# group: Inputs
select_face = DSFaceSelection()  # 1 picked in the model
levels = Levels("Level 0")
select_faces = SelectFaces()  # 3 picked in the model

# group: Project the parking area and exclusion zone curves onto a level.
projectBoundaryOntoPlane = Custom[ProjectBoundaryOntoPlane](boundarySurface=select_face, siteLevel=levels)  # To project the boundaries developed from selected faces onto a plane.
projectBoundaryOntoPlane_2 = Custom[ProjectBoundaryOntoPlane](boundarySurface=select_faces, siteLevel=levels)

# group: Internal and perimeter roadway surfaces.
internalandRoadwaySurfaces = Custom[InternalandRoadwaySurfaces](boundaryCurve=projectBoundaryOntoPlane.PolyCurve)  # Creates the internal parking and roadway surfaces.

code_block = CodeBlock(roadwaySurface=internalandRoadwaySurfaces.perimeterRoadwaySurface) { roadwaySurface; }

# group: Create new surfaces from the projected curves.
byPatch = Surface.ByPatch(closedCurve=projectBoundaryOntoPlane.PolyCurve)
byPatch_2 = Surface.ByPatch(closedCurve=projectBoundaryOntoPlane_2.PolyCurve)

# group: Create the exclusion zone spots.
exclusionZoneSpots = Custom[ExclusionZoneSpots](perimeterRoadwaySurface=internalandRoadwaySurfaces.perimeterRoadwaySurface, internalParkingSurface=internalandRoadwaySurfaces.internalParkingSurface, boundarySurface=byPatch, exclusionZone=byPatch_2)  # Create parking spots along the perimeter of the exclusion zones.
