# Dynamo graph Nodes_GenerateBoundingRectangle.dyn (Dynamo 3.3.0.6316)

# group: Inputs
select_face = DSFaceSelection()  # 1 picked in the model
levels = Levels("Ground Level")
number_slider = DoubleSlider(127, range=0..360 step 1)

# group: Project the parking area boundary curve onto a level.
projectBoundaryOntoPlane = Custom[ProjectBoundaryOntoPlane](boundarySurface=select_face, siteLevel=levels)  # To project the boundaries developed from selected faces onto a plane.

code_block = CodeBlock { 2; }

# group: Internal and perimeter roadway surfaces.
internalandRoadwaySurfaces = Custom[InternalandRoadwaySurfaces](boundaryCurve=projectBoundaryOntoPlane.PolyCurve, perimeterAisleWidth=code_block)  # Creates the internal parking and roadway surfaces.

code_block_2 = CodeBlock(perimeterRoadwaySurface=internalandRoadwaySurfaces.perimeterRoadwaySurface) { perimeterRoadwaySurface; }
code_block_3 = CodeBlock(internalBoundaryCurve=internalandRoadwaySurfaces.internalBoundaryCurve) { internalBoundaryCurve; }

# group: Create the bounding rectangle for the internal parking area.
generateBoundingRectangle = Custom[GenerateBoundingRectangle](degrees=number_slider, closedCurve=internalandRoadwaySurfaces.internalBoundaryCurve)  # Generates a rectangle around a planar closed curve, ensuring the curve is completely encapsulated.
