# Dynamo graph Nodes_GeneratePatterns.dyn (Dynamo 3.3.0.6316)

# group: Inputs
integer_slider = IntegerSlider(1, range=1..4 step 1)
integer_slider_2 = IntegerSlider(4, range=1..4 step 1)
number_slider = DoubleSlider(3.5, range=1..5 step 0.1)
number_slider_2 = DoubleSlider(360, range=0..360 step 1)
number_slider_3 = DoubleSlider(2.5, range=1..5 step 0.1)
number_slider_4 = DoubleSlider(5, range=1..5 step 0.1)

# group: Generate parking patterns.
generatePatterns = Custom[GeneratePatterns](patternAngle=integer_slider, patternType=integer_slider_2, islandWidth=number_slider, internalRotation=number_slider_2, bayWidth=number_slider_3, bayLength=number_slider_4)  # Creates the parking patterns.

code_block = CodeBlock(parkingPattern=generatePatterns.parkingPattern) { parkingPattern; }
