# Dynamo graph Nodes_GeneratePerimeterSpots.dyn (Dynamo 3.3.0.6316)

code_block = CodeBlock { 9; }

# group: Inputs
select_face = DSFaceSelection()  # 1 picked in the model
levels = Levels("Level 1")

# group: Project the layout surface onto a level.
projectBoundaryOntoPlane = Custom[ProjectBoundaryOntoPlane](boundarySurface=select_face, siteLevel=levels)  # To project the boundaries developed from selected faces onto a plane.
byPatch = Surface.ByPatch(closedCurve=projectBoundaryOntoPlane.PolyCurve)

# group: Generate the perimeter parking spots
generatePerimeterSpots = Custom[GeneratePerimeterSpots](bayLength=code_block, boundarySurface=byPatch, basePlane=projectBoundaryOntoPlane.Plane)  # Creates parking spots along the perimeter of the input boundary surface.

code_block_2 = CodeBlock(greenSurface=generatePerimeterSpots.greenSurface) { greenSurface; }
code_block_3 = CodeBlock(parkingSpots=generatePerimeterSpots.parkingSpots) { parkingSpots; }
