# Dynamo graph Nodes_InternalBaysZonesRoutes.dyn (Dynamo 3.3.0.6316)

# group: Inputs
# note: Select "1" for 45 degree parking, "2" for 60 degree parking, and "3" for 90 degree parking. Note that the angles are not applied to the perimeter parking bays and herringbone pattern. The herringbone pattern will always be at 45 degrees.
in_parking_angle_selector = IntegerSlider(3, range=1..4 step 1)  # graph input
# note: Select "1" for the non interlocking pattern which allows for an island between the bay rows, "2" for the interlocking pattern, "3" for the mirrored interlocking pattern, and "4" for the herringbone pattern.
in_parking_pattern_selector = IntegerSlider(3, range=1..4 step 1)  # graph input
# note: The width of the island between the non interlocking parking pattern.
in_parking_island_width = DoubleSlider(0.5, range=0.5..2 step 0.1)  # graph input
# note: The rotation angle of the setout line of the center bays.
in_bay_setout_line_rotation = DoubleSlider(0, range=0..360 step 1)  # graph input
# note: The width of the parking bays.
in_parking_bay_width = DoubleSlider(2.5, range=0.5..5 step 0.1)  # graph input
# note: The length of the parking bays.
in_parking_bay_length = DoubleSlider(5, range=0.5..10 step 0.1)  # graph input
# note: The vehicle turning radius at the concave corners of the perimeter aisle.
in_internal_turning_radius = DoubleSlider(3.5, range=3.5..10 step 0.1)  # graph input
# note: The vehicle turning radius at the convex corners of the perimeter aisle.
in_external_turning_radius = DoubleSlider(5, range=5..10 step 0.1)  # graph input
# note: Define the parking region with a filled region.
in_select_parking_region = DSFaceSelection()  # 1 picked in the model; graph input
# note: Select the level to host the parking bays.
in_select_parking_level = Levels("Level 0")  # graph input
# note: The width of the perimeter aisle for the overall parking layout.
in_perimeter_aisle_width = DoubleSlider(7, range=7..10 step 0.1)  # graph input
# note: Select "1" for one way traffic, and "2" for two way traffic.
in_aisle_type_selector = IntegerSlider(2, range=1..2 step 1)  # graph input
# note: Select "1" for regular 90 degree parking along the perimeter of the exclusion area, and "2" for parallel parking.
in_exclusion_area_parking_type = IntegerSlider(2, range=1..2 step 1)  # graph input
# note: The width of the walkway along the perimeter of the exclusion zone.
in_exclusion_zone_walkway_width = DoubleSlider(0.4, range=0..3 step 0.1)  # graph input
# note: The radius at the corners of the internal parking islands.
in_island_corner_radius = DoubleSlider(1.2, range=0..5 step 0.1)  # graph input
# note: The width of the one way aisle.
in_one_way_aisle_width = DoubleSlider(4.4, range=4..10 step 0.1)  # graph input
# note: Establish the non-parking areas within the parking lot by designating them as filled regions. These regions, referred to as 'exclusion zones', are spaces where parking will not be permitted.
in_select_exclusion_zones = SelectFaces()  # 3 picked in the model; graph input
# note: Select lines to define the driving routes of the internal parking area.
in_select_axial_route_s = DSModelElementsByCategorySelection("OST_Lines")  # 2 picked in the model; graph input
# note: The width of the axial routes. 7000mm is set as the minimum.
in_axial_route_width = DoubleSlider(7, range=7..10 step 0.1)  # graph input
# note: The width of the exclusion zone perimeter aisle.
in_exclusion_zone_aisle_width = DoubleSlider(4, range=4..10 step 0.1)  # graph input

# group: Project the site boundary onto a level.
projectBoundaryOntoPlane = Custom[ProjectBoundaryOntoPlane](boundarySurface=in_select_parking_region, siteLevel=in_select_parking_level)  # To project the boundaries developed from selected faces onto a plane.
curves = PolyCurve.Curves(polyCurve=projectBoundaryOntoPlane.PolyCurve)

# group: Create the internal and perimeter roadway surfaces.
internalandRoadwaySurfaces = Custom[InternalandRoadwaySurfaces](concaveCornerRadius=in_internal_turning_radius, convexCornerRadius=in_external_turning_radius, boundaryCurve=projectBoundaryOntoPlane.PolyCurve, bayLength=in_parking_bay_length, perimeterAisleWidth=in_perimeter_aisle_width)  # Creates the internal parking and roadway surfaces.

# group: Generate the bounding rectangle of the internal parking area.
generateBoundingRectangle = Custom[GenerateBoundingRectangle](degrees=in_bay_setout_line_rotation, closedCurve=internalandRoadwaySurfaces.internalBoundaryCurve)  # Generates a rectangle around a planar closed curve, ensuring the curve is completely encapsulated.

# group: Generate the parking patterns.
generatePatterns = Custom[GeneratePatterns](patternAngle=in_parking_angle_selector, patternType=in_parking_pattern_selector, islandWidth=in_parking_island_width, internalRotation=in_bay_setout_line_rotation, bayWidth=in_parking_bay_width, bayLength=in_parking_bay_length, rectangleLength=generateBoundingRectangle.length)  # Creates the parking patterns.

# group: Create projected exclusion zone surfaces.
projectBoundaryOntoPlane_2 = Custom[ProjectBoundaryOntoPlane](boundarySurface=in_select_exclusion_zones, siteLevel=in_select_parking_level)
byPatch = Surface.ByPatch(closedCurve=projectBoundaryOntoPlane_2.PolyCurve)

# group: Project the axial route curves onto a plane.
curves_2 = Element.Curves(element=in_select_axial_route_s)
projectRouteCurvesOntoPlane = Custom[ProjectRouteCurvesOntoPlane](axialRouteCurves=curves_2, siteLevel=in_select_parking_level)  # To project selected route curves onto a Revit plane.

# group: Generate the internal parking spots.
internalBaysZonesRoutes = Custom[InternalBaysZonesRoutes](elongatedParkingPatterns=generatePatterns.elongatedParkingPatterns, greenAreaSurfaces=generatePatterns.greenAreaSurfaces, replacementElongatedPattern=generatePatterns.replacementElongatedPattern@L2, patternType=in_parking_pattern_selector, aisleTypeSelector=in_aisle_type_selector, patternAngle=in_parking_angle_selector, boundingRectangle=generateBoundingRectangle.Rectangle, patternWidth=generatePatterns.patternWidth, replacementPattern=generatePatterns.replacementPattern@L2, zoneParkingType=in_exclusion_area_parking_type, zoneWalkwayWidth=in_exclusion_zone_walkway_width, concaveCornerRadius=in_internal_turning_radius, islandCornerRadius=in_island_corner_radius, oneWayAisleWidth=in_one_way_aisle_width, perimeterAisleWidth=in_perimeter_aisle_width, patternCenterLine=generatePatterns.patternCenterLine, parkingPattern=generatePatterns.parkingPattern, bayLength=in_parking_bay_length, perimeterCurves=curves, exclusionZone=byPatch, axialRouteCurves=projectRouteCurvesOntoPlane.projectedAxialRouteCurves, axialRouteWidth=in_axial_route_width, bayWidth=in_parking_bay_width, exclusionZoneAisleWidth=in_exclusion_zone_aisle_width, convexCornerRadius=in_external_turning_radius)  # Creates internal parking bays and allows the delineation of movement routes within the parking layout.

code_block = CodeBlock(parkingSpots=internalBaysZonesRoutes.parkingSpots) { parkingSpots; }
code_block_2 = CodeBlock(islandSurfaces=internalBaysZonesRoutes.islandSurfaces) { islandSurfaces; }
