# Dynamo custom node ExclusionZoneSpots.dyf (Dynamo 3.3.0.6316)
# category: Feasibility.Parking
# Create parking spots along the perimeter of the exclusion zones.

# group: Inputs.
exclusionZone = Input(exclusionZone: var[]..[])  # surface geometry representing the exclusion zones.
zoneWalkwayWidth = Input(zoneWalkwayWidth: double = 1.5)  # the width of the walkway along the perimeter of the building and green zones.
convexCornerSpacing = Input(convexCornerSpacing: double = 0.3)  # the distance of the parking bays from the convex corners.
concaveCornerSpacing = Input(concaveCornerSpacing: double = 4)  # the distance of the parking bays from the concave corners.
zoneParkingType = Input(zoneParkingType: int = 1)  # Select "1" for regular 90 degree parking along the perimeter of the exclusion area, and "2" for parallel parking.
bayLength = Input(bayLength: double = 5)  # the length of the vehicular parking bays.
bayWidth = Input(bayWidth: double = 2.5)  # the width of the vehicular parking bays.
aisleWidth = Input(aisleWidth: double = 7)  # the width of the perimeter aisle.
perimeterRoadwaySurface = Input(perimeterRoadwaySurface: var)  # a surface covering the length of the perimeter spots and the width of the perimeter aisle.
boundarySurface = Input(boundarySurface: Autodesk.DesignScript.Geometry.Surface)  # the input surface defining the full parking area.
convexCornerRadius = Input(convexCornerRadius: double = 3)  # the radial value at the convex corners of the perimeter spot layout.
internalParkingSurface = Input(internalParkingSurface: var)  # the parking lot surface minus the depth of the perimeter parking bays.

# group: Offset the exclusion zone perimeter by walkway width.
# note: Flatten the selected surfaces into one list.
flatten = List.Flatten(list=exclusionZone)
# note: Get the perimeter curves of the surface.
perimeterCurves = Surface.PerimeterCurves(surface=flatten)
# note: Get number of perimeter curves for each exclusion zone.
count = List.Count(list=perimeterCurves@L2)
# note: Sort the exclusion zones by the number of perimeter curves they have. Prevents an error downstream.
sortByKey = List.SortByKey(list=perimeterCurves, keys=count)
# note: Reverse the list so the perimeter curve list with the highest curve count is put on top.
reverse = List.Reverse(list=sortByKey.sortedList)
byJoinedCurves = PolyCurve.ByJoinedCurves(curves=reverse)
code_block = CodeBlock { Vector.ZAxis(); }
# note: Offset the exclusion zone perimeter to incorporate the width of the perimeter walkway/threshold.
offsetMany = Curve.OffsetMany(curve=byJoinedCurves, signedDistance=zoneWalkwayWidth, planeNormal=code_block)
curves = PolyCurve.Curves(polyCurve=offsetMany)
# note: Create a new surface that includes the walkway width.
byPatch = Surface.ByPatch(closedCurve=offsetMany)

# group: Get boundary curve vectors.
code_block_2 = CodeBlock { [0,1]; }
# note: Get the start and end points of the projected curves.
pointAtParameter = Curve.PointAtParameter(curve=curves@L1, param=code_block_2)
# note: Get the lengths of the initial projected curve sublists.
count_2 = List.Count(list=curves@L2)
# note: Chop the point list by the lengths of the initial projected curve sublists.
chop = List.Chop(list=pointAtParameter, lengths=count_2)
# note: Create polycurves connecting the paired start and end points.
byPoints = PolyCurve.ByPoints(points=chop)
# note: Get the lines from the polycurves.
curves_2 = PolyCurve.Curves(polyCurve=byPoints)
# note: Flatten the line list.
flatten_2 = List.Flatten(list=curves_2@L3)
# note: Get the vectors (directions) of the lines. These vectors will be used to work out the corner angles of the parking area.
direction = Line.Direction(line=flatten_2)

# group: Pair the boundary curves at each corner.
code_block_3 = CodeBlock { -1; }
# note: Shift the position of all the lines by -1 to allow for pairing of adjacent lines.
shiftIndices = List.ShiftIndices(list=flatten_2@L2, amount=code_block_3)
# note: Reverse the direction of the curves.
reverse_2 = Curve.Reverse(curve=shiftIndices)
# note: Combine the original line sublists with the shifted and reversed line sublists.
list_create = List.Create(item0=reverse_2, item1=flatten_2)
# note: Pair the sublists in the first and second lists.
transpose = List.Transpose(lists=list_create)
# note: Pair the lines in the first and second list. The paired lines will be used to create the perimeter parking setout points.
transpose_2 = List.Transpose(lists=transpose@L3)

# group: Get corner angles of the exclusion zone boundaries.
code_block_4 = CodeBlock { -1; }
# note: Shift the position of all the vectors by -1.
shiftIndices_2 = List.ShiftIndices(list=direction@L2, amount=code_block_4)
# note: Reverse the direction of the shifted vectors.
reverse_3 = Vector.Reverse(vector=shiftIndices_2)
# note: Vector along the Z Axis.
ZAxis = Vector.ZAxis()
# note: We calculate the angles between a set of original vectors and their manipulated versions (shifted and reversed), using the Z vector as our rotation axis. These generated angles provide us with the corner angles of the parking area.
angleAboutAxis = Vector.AngleAboutAxis(vector=direction, otherVector=reverse_3, rotationAxis=ZAxis)

# group: Sort the paired convex and concave corner lines.
# note: In this step, we generate a true/false boolean list. This list will be instrumental in sorting lines, corner points, and angles for both concave and convex corners. Angles less than 180 degrees are labeled as 'false', while those greater than 180 degrees are labeled as 'true'.
code_block_5 = CodeBlock(corner_angle=angleAboutAxis) { corner_angle > 180; }
# note: By utilizing the true/false boolean list, we are able to distinguish between the paired convex and concave corner boundary lines in the parking area. Lines in the 'in' list represent convex corner lines, while those in the 'out' list signify concave corner lines.
filterByBoolMask = List.FilterByBoolMask(list=transpose_2, mask=code_block_5)

# group: Sort convex and concave corner points.
# note: Here we get the corner points of the parking area.
endPoint = Curve.EndPoint(curve=flatten_2)
# note: By utilizing the above true/false boolean list, we are able to distinguish between convex and concave corner points in the parking area. Angles in the 'in' list represent convex corner points, while those in the 'out' list signify concave corner points.
filterByBoolMask_2 = List.FilterByBoolMask(list=endPoint, mask=code_block_5)

# group: Create convex corner setout points.
# note: Calculate the curve parameter at the convex corner by using the sorted convex corner points on the corresponding sorted convex lines.
parameterAtPoint = Curve.ParameterAtPoint(curve=filterByBoolMask.in, point=filterByBoolMask_2.in)
code_block_6 = CodeBlock { false; }
# note: In this step, we establish the setout points for the parking bay around the convex corner. We do this by using the 'convex corner spacing' parameter as the chord length input.
pointAtChordLength = Curve.PointAtChordLength(curve=filterByBoolMask.in, chordLength=convexCornerSpacing, parameterLocation=parameterAtPoint, forward=code_block_6)

# group: Sort convex and concave corner angles.
# note: By utilizing the above true/false boolean list, we are able to distinguish between convex and concave angles in the parking area. Angles in the 'in' list represent convex corners, while those in the 'out' list signify concave corners.
filterByBoolMask_3 = List.FilterByBoolMask(list=angleAboutAxis, mask=code_block_5)

# group: Conditional exclusion zone parking bay length.
# note: Create conditional parking length parameter to switch between parallel parking and 90° parking at the exclusion zones.
code_block_7 = CodeBlock(length_selector=zoneParkingType, regular_length=bayLength, parallel_length=bayWidth)
# ---------- code_block_7.designscript (2 lines) ----------
//conditional statement to choose between parallel or regular parking lengths.
parking_length = length_selector == 1? regular_length: parallel_length;
# ----------------------------------------

# group: Create concave corner setout points.
code_block_8 = CodeBlock { false; }
clean = List.Clean(list=filterByBoolMask.out, preserveIndices=code_block_8)
clean_2 = List.Clean(list=filterByBoolMask_3.out, preserveIndices=code_block_8)
code_block_9 = CodeBlock(concave_angle=clean_2, concave_corner_spacing=concaveCornerSpacing, parking_bay_length=code_block_7)
# ---------- code_block_9.designscript (20 lines) ----------
//calculate distance for concave corner setout points.
	//calculate the equal isosceles angle.
	equal_angle = (180 - concave_angle) / 2;

	//calculate length of side of isoceles triangle.
	side_length =
	concave_corner_spacing * DSCore.Math.Sin(equal_angle) /
	DSCore.Math.Sin(concave_angle);

	//calculate the hypotenuse length of parking bay side triangle.
	hypotenuse_length =
	parking_bay_length / DSCore.Math.Cos(90 - concave_angle);

	//calculate the base length of parking bay side triangle.
	base_length =
	parking_bay_length * DSCore.Math.Tan(90 - concave_angle);

	//concave corner setout distance.
	concave_corner_distance =
	side_length + hypotenuse_length + base_length;
# ----------------------------------------
clean_3 = List.Clean(list=filterByBoolMask_2.out, preserveIndices=code_block_8)
# note: Calculate the curve parameter at the concave corner by using the sorted convex corner points on the corresponding sorted concave lines.
parameterAtPoint_2 = Curve.ParameterAtPoint(curve=clean, point=clean_3)
code_block_10 = CodeBlock { false; }
# note: In this step, we establish the setout points for the parking bay around the concave corner. We do this by using the 'concave corner distance' value generated below as the chord length input.
pointAtChordLength_2 = Curve.PointAtChordLength(curve=clean, chordLength=code_block_9.concave_corner_distance, parameterLocation=parameterAtPoint_2, forward=code_block_10)

# group: Pair setout points for the perimeter parking setout lines.
# note: Combine the convex and concave corner setout points in one list.
list_create_2 = List.Create(item0=pointAtChordLength, item1=pointAtChordLength_2)
code_block_11 = CodeBlock { true; }
# note: In this step, we determine the indices of the convex corners from the boolean list. We then use these indices to arrange the perimeter parking bay setout points following the original sequence of the input parking layout geometry
allIndicesOf = List.AllIndicesOf(list=code_block_5@L2, item=code_block_11)
code_block_12 = CodeBlock { false; }
# note: In this step, we determine the indices of the concave corners from the boolean list. We then use these indices to arrange the perimeter parking bay setout points following the original sequence of the input parking layout geometry
allIndicesOf_2 = List.AllIndicesOf(list=code_block_5@L2, item=code_block_12)
# note: Combine the convex and concave corner indices in one list.
list_create_3 = List.Create(item0=allIndicesOf, item1=allIndicesOf_2)
# note: Transpose the convex and concave corner points to be in the right order for sorting.
python_script = Python(IN[0]=list_create_2, IN[1]=list_create_3)  # CPython3
# ---------- python_script.python (48 lines) ----------
# Load the required libraries.
import sys
import clr
clr.AddReference('ProtoGeometry')
from Autodesk.DesignScript.Geometry import *
clr.AddReference('DSCoreNodes') 
import DSCore
from DSCore import *

# Inputs
point_list = IN[0]
index_list = IN[1]

# Get booleans to check if both sublists in the second list are not empty.
empty_bool =[]
for list in index_list[1]:
    empty_bool.append(List.IsEmpty(list))

# Make the original list the point list if all the items are empty.
if False not in empty_bool:
    point_slice = point_list[1]
# Add empty list where necessary to mirror the index list if all items are not empty in second list. 
else:
    point_slice = point_list[1]
    for index, bool in enumerate(empty_bool):
        # Insert an empty list into the point list where the boolean is True.
        if bool == True:
            point_slice.insert(index, List.Empty)


# Add each items in the point slice to the end of each list in the point list.
if False not in empty_bool:
    organized_list = []
    for element in point_list[0]:
        # Add an "empty list" contained in the point slice to the end of each sublist in the concave corner setout points.
        element.append(point_slice)
        organized_list.append(element)
else:
    organized_list = []
    for element, item in zip(point_list[0], point_slice):
        if len(item) > 0:
            for sub_item in item:
                element.append(sub_item)
        else:
            element.append(item)
        organized_list.append(element)

OUT = organized_list
# ----------------------------------------
code_block_13 = CodeBlock { false; }
# note: The transposition creates a null value when a shape does not have concave corners and others do. The null value is cleared here to make sure the list lengths are similar for correct sorting.
clean_4 = List.Clean(list=python_script, preserveIndices=code_block_13)
# note: Transpose the list to combine the convex and concave indices sublists correctly for each exclusion zone.
transpose_3 = List.Transpose(lists=list_create_3)
flatten_3 = List.Flatten(list=transpose_3@L3, lacing=Longest)
# note: Sort the convex and concave corner setout points using the indices.
sortByKey_2 = List.SortByKey(list=clean_4@L3, keys=flatten_3@L2)
# note: Reverse the order of the paired setout points.
reverse_4 = List.Reverse(list=sortByKey_2.sortedList@L3)
flatten_4 = List.Flatten(list=reverse_4@L3)
code_block_14 = CodeBlock { -1; }
# note: Shift the list of setout points by -1. This allows for the construction of a setout line that serves as a reference for setting out the perimeter parking bays.
shiftIndices_3 = List.ShiftIndices(list=flatten_4@L2, amount=code_block_14)
code_block_15 = CodeBlock { 2; }
# note: Pair the setout points and create the setout lines.
chop_2 = List.Chop(list=shiftIndices_3@L2, lengths=code_block_15)

# group: Conditional exclusion zone parking bay width.
# note: Create conditional parking width parameter to switch between parallel parking and 90° parking at the exclusion zones.
code_block_16 = CodeBlock(length_selector=zoneParkingType, parallel_length=bayWidth, regular_length=bayLength)
# ---------- code_block_16.designscript (2 lines) ----------
//conditional statement to choose between parallel or regular parking widths.
parking_width = length_selector == 1? parallel_length: regular_length;
# ----------------------------------------

# group: Create the center points of the perimeter parking bays.
# note: Create the perimeter parking bay curves.
byPoints_2 = PolyCurve.ByPoints(points=chop_2)
# note: Get the length of the perimeter parking bay curves.
length = Curve.Length(curve=byPoints_2)
# note: To divide the perimeter parking setout curves into the required number of parking spots.
code_block_17 = CodeBlock(setout_line_length=length, parking_bay_width=code_block_16)
# ---------- code_block_17.designscript (7 lines) ----------
//work out the number of perimeter parking spots per setout curve.
perimeter_parking_number =
(setout_line_length / parking_bay_width);

//the required number of perimeter parking setout points.
perimeter_parking_point_number =
perimeter_parking_number + 1;
# ----------------------------------------
# note: Round the perimeter division numbers to a lower integer value.
floor = Math.Floor(number=code_block_17.perimeter_parking_point_number)
# note: Create parameters to split the perimeter parking bay setout curves.
code_block_18 = CodeBlock(point_number=floor) { 0..1..#point_number; }
# note: Split the perimeter setout curves with the generated parameters.
splitByParameter = Curve.SplitByParameter(curve=byPoints_2, parameters=code_block_18)
code_block_19 = CodeBlock { 0.5; }
# note: Here we get the center points of the curves. They will be translated (moved) and used as the center points of the perimeter parking bays.
pointAtParameter_2 = Curve.PointAtParameter(curve=splitByParameter, param=code_block_19)
code_block_20 = CodeBlock { 0.5; }
# note: Create a coordinate system at the center of the perimeter setout curves.
coordinateSystemAtParameter = Curve.CoordinateSystemAtParameter(curve=byPoints_2, param=code_block_20)
# note: Get the X vector of the coordinate system for translating (moving) the perimeter parking center points.
XAxis = CoordinateSystem.XAxis(coordinateSystem=coordinateSystemAtParameter)
# note: Flip the direction of the X vector.
reverse_5 = Vector.Reverse(vector=XAxis)
# note: Here, we divide the parking bay length by two and use the resulting value to translate (move) the points.
code_block_21 = CodeBlock(parking_bay_length=code_block_7) { parking_bay_length/2; }
# note: Move the points to create the center of the perimeter parking bays.
translate = Geometry.Translate(geometry=pointAtParameter_2, direction=reverse_5, distance=code_block_21)

# group: Add the perimeter parking bay rectangles.
# note: Create planes to host perimeter parking bay rectangles.
byOriginNormal = Plane.ByOriginNormal(origin=translate)
# note: Get the widths of the perimeter bays from the split perimeter curves.
length_2 = Curve.Length(curve=splitByParameter)
# note: Create the perimeter parking bay rectangles.
byWidthLength = Rectangle.ByWidthLength(plane=byOriginNormal, width=length_2, length=code_block_7)
XAxis_2 = Vector.XAxis()
# note: Get the lines from the perimter setout curves.
curves_3 = PolyCurve.Curves(polyCurve=byPoints_2)
# note: Get the vectors of the lines.
direction_2 = Line.Direction(line=curves_3)
ZAxis_2 = Vector.ZAxis()
# note: Generate the rotation angles for the perimeter parking bays.
angleAboutAxis_2 = Vector.AngleAboutAxis(vector=XAxis_2, otherVector=direction_2, rotationAxis=ZAxis_2)
flatten_5 = List.Flatten(list=angleAboutAxis_2@L3)
# note: Rotate the perimeter parking bays.
rotate = Geometry.Rotate(geometry=byWidthLength@L3, basePlane=byOriginNormal@L3, degrees=flatten_5@L2, lacing=Longest)
# note: Get list of parking spot rectangle widths to remove any less than the required parking width.
width = Rectangle.Width(rectangle=rotate)
# note: Here we round the rectangle widths to a higher integer.
ceiling = Math.Ceiling(number=width)
# note: Boolean list to filter the parking bays that are less than the required width.
code_block_22 = CodeBlock(actual_parking_width=ceiling, required_parking_width=code_block_16) { actual_parking_width < required_parking_width; }
# note: Sort the bays that are width compliant from the bays that are not.
filterByBoolMask_4 = List.FilterByBoolMask(list=rotate, mask=code_block_22)

# group: Create a surface representing the perimeter aisle of the exclusion zones.
byJoinedCurves_2 = PolyCurve.ByJoinedCurves(curves=curves)
code_block_23 = CodeBlock(parking_bay_length=code_block_7, aisle_width=aisleWidth) { parking_bay_length + aisle_width; }
code_block_24 = CodeBlock { Vector.ZAxis(); }
# note: Offset the exclusion zone walkway boundary by the parking bay length + aisle width
offsetMany_2 = Curve.OffsetMany(curve=byJoinedCurves_2, signedDistance=code_block_23, planeNormal=code_block_24)
# note: Create surface to be subtracted from.
byPatch_2 = Surface.ByPatch(closedCurve=offsetMany_2)
code_block_25 = CodeBlock(parking_bay_length=code_block_7) { parking_bay_length + 1; }
# note: Offset the exclusion zone walkway boundary by the parking bay length + 1mm.
offsetMany_3 = Curve.OffsetMany(curve=byJoinedCurves_2, signedDistance=code_block_25, planeNormal=code_block_24)
# note: Create surface to be subtracted.
byPatch_3 = Surface.ByPatch(closedCurve=offsetMany_3)
# note: Create the aisle surface by subtracting walkway boundary surface from the surface encompassing the exlusion zone, walkway, parking and aisle.
difference = Surface.Difference(surface=byPatch_2@L1, others=byPatch_3@L1)
# note: Join the aisle surface.
byUnion = Surface.ByUnion(surfaces=difference)

# group: Remove the bays intersecting with the perimeter aisle.
# note: Create boolean list to see if the parking spots intersect with the composite aisle surface.
doesIntersect = Geometry.DoesIntersect(geometry=byUnion, other=filterByBoolMask_4.out)
# note: Sort the parking spots that intersect with the aisle.
filterByBoolMask_5 = List.FilterByBoolMask(list=filterByBoolMask_4.out, mask=doesIntersect)

# group: Create surfaces to remove unusable parking bays not removed through perimeter aisle intersection.
# note: Create boolean list to see what exclusion zone surfaces intersect with each other.
doesIntersect_2 = Geometry.DoesIntersect(geometry=byPatch_3@L1, other=byPatch_3@L1, lacing=CrossProduct)
# note: Count the true values in each sublist.
countTrue = List.CountTrue(list=doesIntersect_2@L2)
# note: Check which sublists have more than one true value. More than one true value indicates that the exclusion zone intersects with at least one other exclusion zone.
code_block_26 = CodeBlock(true_count=countTrue) { true_count > 1; }
code_block_27 = CodeBlock { true; }
# note: Indices of exclustion zones that intersect with one or more exclusion zones.
allIndicesOf_3 = List.AllIndicesOf(list=code_block_26, item=code_block_27)
# note: Get the exclusion zones that intersect with other exclusion zones.
getItemAtIndex = List.GetItemAtIndex(list=byPatch_3, index=allIndicesOf_3)
count_3 = List.Count(list=byPatch_3)
# note: Duplicate the original exclusion zone surface list to match the number of exclusion zones.
cycle = List.Cycle(list=byPatch_3@L3, amount=count_3)
# note: Create indices for each exclusion zone surface.
code_block_28 = CodeBlock(count=count_3) { 0..count-1; }
# note: Remove the original exclusion zones from the duplicated lists. To avoid intersecting the exclusion zones with themselves down the line.
removeItemAtIndex = List.RemoveItemAtIndex(list=cycle@L2, indices=code_block_28@L1)
# note: Get the surface lists for the exclusion zones that intersect with other exclusion zones.
getItemAtIndex_2 = List.GetItemAtIndex(list=removeItemAtIndex@L3, index=allIndicesOf_3)
# note: Remove the boolean of the exlusion zones from the boolean lists. To avoid intersecting the exclusion zones with themselves down the line.
removeItemAtIndex_2 = List.RemoveItemAtIndex(list=doesIntersect_2@L2, indices=code_block_28@L1)
# note: Get the boolean lists for the exclusion zones that intersect with other exclusion zones.
getItemAtIndex_3 = List.GetItemAtIndex(list=removeItemAtIndex_2@L3, index=allIndicesOf_3)
# note: Filter the exclusion zones that intersect with the primary exclusion zones.
filterByBoolMask_6 = List.FilterByBoolMask(list=getItemAtIndex_2@L2, mask=getItemAtIndex_3@L2)
# note: Intersect the primary exclusion zone surfaces with the other exclusion zones they intersect with to create surfaces to be used in removing unfeasible parking bays.
intersect = Geometry.Intersect(geometry=getItemAtIndex@L1, other=filterByBoolMask_6.in@L2)

# group: Remove duplicate surfaces to form one polysurface.
flatten_6 = List.Flatten(list=intersect)
code_block_29 = CodeBlock { 0.5; }
# note: Get the surface center points.
pointAtParameter_3 = Surface.PointAtParameter(surface=flatten_6, u=code_block_29, v=code_block_29)
string_from_object = FromObject(object=pointAtParameter_3)
uniqueItems = List.UniqueItems(list=string_from_object)
allIndicesOf_4 = List.AllIndicesOf(list=string_from_object, item=uniqueItems)
firstItem = List.FirstItem(list=allIndicesOf_4@L2)
getItemAtIndex_4 = List.GetItemAtIndex(list=flatten_6, index=firstItem)
# note: Create a polysurface to be used for filtering the unusable parking spots.
byJoinedSurfaces = PolySurface.ByJoinedSurfaces(surfaces=getItemAtIndex_4)

# group: Remove the unusable parking spots not intersecting with the perimeter aisle.
# note: Create boolean list to see if the parking spots intersect with the composite aisle surface.
doesIntersect_3 = Geometry.DoesIntersect(geometry=byJoinedSurfaces, other=filterByBoolMask_5.out)
# note: Sort the parking spots that intersect with the aisle.
filterByBoolMask_7 = List.FilterByBoolMask(list=filterByBoolMask_5.out, mask=doesIntersect_3)

# group: Swap between the filtered aisle intersecting spots and the filtered unusable spots depending on if the exclusion zones intersect or not.
code_block_30 = CodeBlock { true; }
# note: Check if any exclusion zone geometries intersect with each other. A true value indicates that there is at least one intersection.
contains = List.Contains(list=code_block_26, item=code_block_30)
python_script_2 = Python(IN[0]=filterByBoolMask_5.out, IN[1]=filterByBoolMask_7.out, IN[2]=contains)  # CPython3
# ---------- python_script_2.python (14 lines) ----------
# Inputs
filtered_aisle_intersecting_spots = IN[0]
filtered_unusable_spots = IN[1]
# Boolean to check if there are any exclusion zones that intersect with each other.
intersect_bool = IN[2]

# To choose between the filtered parking spots depending on exclusion zone intersections.
if intersect_bool == True:
    parking_spots = filtered_unusable_spots
else:
    parking_spots = filtered_aisle_intersecting_spots
    

OUT = parking_spots
# ----------------------------------------

# group: Remove exclusion zone parking spots intersecting with the perimeter aisle.
# note: Create boolean list to filter the exclusion zone parking spots that intersect with the perimeter roadway.
doesIntersect_4 = Geometry.DoesIntersect(geometry=python_script_2, other=perimeterRoadwaySurface)
# note: Filter the exclusion zone parking spots that intersect with the perimeter roadway.
filterByBoolMask_8 = List.FilterByBoolMask(list=python_script_2, mask=doesIntersect_4)

# group: Remove exclusion zone parking spots not intersecting with the parking area.
# note: Create boolean list to filter the exclusion zone parking spots that do not intersect with the parking area.
doesIntersect_5 = Geometry.DoesIntersect(geometry=filterByBoolMask_8.out, other=boundarySurface)
# note: Filter the exclusion zone parking spots that do not intersect with the parking lot.
filterByBoolMask_9 = List.FilterByBoolMask(list=filterByBoolMask_8.out, mask=doesIntersect_5)

# group: Workout angles for rotation of the placed exclusion zone perimeter parking spots.
code_block_31 = CodeBlock { false; }
clean_5 = List.Clean(list=filterByBoolMask_9.in, preserveIndices=code_block_31)
curves_4 = PolyCurve.Curves(polyCurve=clean_5)
code_block_32 = CodeBlock { 0; }
getItemAtIndex_5 = List.GetItemAtIndex(list=curves_4@L2, index=code_block_32)
direction_3 = Line.Direction(line=getItemAtIndex_5)
reverse_6 = Vector.Reverse(vector=direction_3)
code_block_33 = CodeBlock { Vector.YAxis(); }
code_block_34 = CodeBlock { Vector.ZAxis(); }
angleAboutAxis_3 = Vector.AngleAboutAxis(vector=reverse_6, otherVector=code_block_33, rotationAxis=code_block_34)

# group: Create perimeter green surfaces.
code_block_35 = CodeBlock { false; }
clean_6 = List.Clean(list=filterByBoolMask_9.in, preserveIndices=code_block_35)
byJoinedCurves_3 = PolyCurve.ByJoinedCurves(curves=curves)
code_block_36 = CodeBlock(parking_bay_length=code_block_7) { parking_bay_length; }
code_block_37 = CodeBlock { Vector.ZAxis(); }
# note: Offset the parking lot's perimeter boundary inwards.
offsetMany_4 = Curve.OffsetMany(curve=byJoinedCurves_3, signedDistance=code_block_36, planeNormal=code_block_37)
# note: Fillet the convex corners.
fillet = PolyCurve.Fillet(polyCurve=offsetMany_4, radius=convexCornerRadius)
byPatch_4 = Surface.ByPatch(closedCurve=fillet)
byPatch_5 = Surface.ByPatch(closedCurve=byJoinedCurves_3)
# note: Subract the exclusion zone surface from the overall exclusion zone surface which includes the parking bays.
difference_2 = Surface.Difference(surface=byPatch_4, others=byPatch_5)
# note: Create boolean list to filter the exclusion zone perimeter green surfaces that do not intersect with the parking area.
doesIntersect_6 = Geometry.DoesIntersect(geometry=difference_2, other=boundarySurface)
# note: Filter the exclusion zone perimeter green surfaces that do not intersect with the parking lot.
filterByBoolMask_10 = List.FilterByBoolMask(list=difference_2, mask=doesIntersect_6)
# note: Create the surfaces of the parking spots for subtraction from the overall green space surface.
byPatch_6 = Surface.ByPatch(closedCurve=clean_6)
flatten_7 = List.Flatten(list=byPatch_6@L3)
# note: Create the green area surfaces by subracting the parking bays from the perimeter surface.
difference_3 = Surface.Difference(surface=filterByBoolMask_10.in, others=flatten_7)
# note: Intersect the green surfaces with the internal parking lot surface to remove any parts of the green surfaces that extend beyond the parking area.
intersect_2 = Geometry.Intersect(geometry=difference_3, other=internalParkingSurface)
flatten_8 = List.Flatten(list=intersect_2)

# group: Outputs.
rotationAngle = Output(angleAboutAxis_3)  # the rotation angle for the parking bays loaded into the Revit model.
parkingSpots = Output(clean_6)  # rectangles representing the parking spots.
greenSurface = Output(flatten_8)  # the surface representing areas with no parking.
