# Dynamo custom node GeneratePatterns.dyf (Dynamo 3.3.0.6316)
# category: Feasibility.Parking
# Creates the parking patterns.

# group: Inputs
bayWidth = Input(bayWidth: double = 2.5)  # the width of the vehicular parking bays.
bayLength = Input(bayLength: double = 5)  # the length of the vehicular parking bays.
patternAngle = Input(patternAngle: int = 1)  # select the parking pattern angle. 1 for 30 degrees, 2 for 45 degrees, 3 for 60 degrees, and 4 for 90 degrees. These angles do no apply to the herringbone pattern which will always be 45 degrees.
rectangleLength = Input(rectangleLength: double = 20)  # the length of the bounding rectangle
islandWidth = Input(islandWidth: double = 1)  # width of the island between the parking rows of the regular parking pattern.
internalRotation = Input(internalRotation: double = 45)  # the rotation of value of the internal parking bays.
patternType = Input(patternType: int = 1)  # Select "1" for the non interlocking pattern which allows for an island between the bay rows, "2" for the interlocking pattern, "3" for the mirrored interlocking pattern, and "4" for the herringbone pattern.

# group: Parking bay angle selection.
# note: Here we create the keys and parking angle values to be added to the dictionary.
code_block = CodeBlock()
# ---------- code_block.designscript (5 lines) ----------
//parking angle selection numbers.
[1, 2, 3, 4];

//parking angles as per Cape Town parking standards.
[60, 45, 30, 0];
# ----------------------------------------
string_from_object = FromObject(object=code_block.out0)
# note: Create a dictionary of parking angles.
byKeysValues = DesignScript.Builtin.Dictionary.ByKeysValues(keys=[string_from_object, string_from_object], values=[code_block.out0, code_block.out1])
string_from_object_2 = FromObject(object=patternAngle)
# note: Select the parking angle from the dictionary based on the angle selector parameter.
valueAtKey = DesignScript.Builtin.Dictionary.ValueAtKey(dictionary=byKeysValues, key=string_from_object_2)

# group: Length of bounding box curve
code_block_2 = CodeBlock(bounding_rectangle_length=rectangleLength) { bounding_rectangle_length; }

# group: Create non interlocked parking bay pattern.
code_block_3 = CodeBlock(bayWidth=bayWidth, bayLength=bayLength, bayAngle=valueAtKey, bounding_curve_length=code_block_2, island_width=islandWidth, setout_angle=internalRotation)
# ---------- code_block_3.designscript (132 lines) ----------
//parameters.
bayWidth;
bayLength;
bayAngle;
bounding_curve_length;
island_width;

//actual bay width against center line.
actualWidth = bayWidth / DSCore.Math.Cos(bayAngle);

//calculate number of bays for copying along line.
bay_copy_number = DSCore.Math.Ceiling(bounding_curve_length / actualWidth);

//create line.
line = Line.ByStartPointEndPoint(Autodesk.Point.ByCoordinates(),
Autodesk.Point.ByCoordinates(0,(actualWidth*bay_copy_number),0));

//get line start point coordinate system.
line_cs = Autodesk.Curve.CoordinateSystemAtParameter (line, 0);

//line start point coordinate system x axis.
cs_x_axis = line_cs.XAxis;

//move center line to offset bays from center island.
moved_line = Geometry.Translate (line, Vector.Reverse(cs_x_axis), island_width/2);

//bay line location points.
locPoints = List.DropItems(Autodesk.Curve.PointAtParameter
	(moved_line,0..1..#bay_copy_number+1),-1);

//bay line plane.
linePlane = Plane.ByOriginNormal(locPoints,Vector.ZAxis());

//bay line plane coordinate system.
planeCS = CoordinateSystem.ByPlane(linePlane);

//line start point.
startPoint = Line.StartPoint(line);

//initial parking bay.
iniPark = Geometry.Rotate(Rectangle.ByWidthLength(bayLength,bayWidth),startPoint,
Vector.ZAxis(),bayAngle);

//bay start point.
bayStart = Autodesk.Curve.StartPoint(iniPark);

//bay plane.
bayPlane = Plane.ByOriginNormal(bayStart,Vector.ZAxis());

//bay coordinate system.
bayCS = CoordinateSystem.ByPlane(bayPlane);

//transform bays to line locations.
transBays = Geometry.Transform (iniPark,bayCS,planeCS);

//mirror parking bays along location line.
	//create plane for mirroring.
	mirror_plane = Plane.ByOriginNormal (startPoint, cs_x_axis);
	//mirror bays.
	mirror_bays = Geometry.Mirror (transBays, mirror_plane);

//combine bays into one list.
combined_bays = List.Join ([transBays, mirror_bays]);

//rotate combined pattern.
	//get rotation center point.
	rotation_point = line.PointAtParameter (0.5);
	//rotate bays.
	rotated_bays = Geometry.Rotate
		(combined_bays, rotation_point, Vector.ZAxis(), setout_angle);

//rotate bays for two-way parking.
rotated_two_way = Geometry.Rotate
		(rotated_bays, rotation_point, Vector.ZAxis(), 180);

//create island.
	//island center plane.
	center_plane = Plane.ByOriginNormal
		(Autodesk.Curve.PointAtParameter(line, 0.5), Vector.ZAxis());
	island_curve = Rectangle.ByWidthLength
		(center_plane, island_width, actualWidth*bay_copy_number);

//calculate overall pattern width.
	//closest triangle width to the island.
	width_1 = bayWidth * DSCore.Math.Sin(bayAngle);
	//furthermost triangle width to the island.
	width_2 = DSCore.Math.Cos(bayAngle) * bayLength;
	//total pattern width.
	pattern_width = (width_1 + width_2) * 2 + island_width;

///****elements for the creation of parking islands****///
//rotate center line.
rotated_center_line = Geometry.Rotate
	(line, rotation_point, Vector.ZAxis(), setout_angle);

//define rectangular surface covering full parking pattern.
	//create the surface rectangle.
	surface_rectangle = Rectangle.ByWidthLength
		(center_plane, pattern_width, actualWidth*bay_copy_number);
	//rotate the rectangle.
	rotated_rectangle = Geometry.Rotate
		(surface_rectangle, rotation_point, Vector.ZAxis(), setout_angle);
	//create the pattern surface.
	pattern_surface = Autodesk.Surface.ByPatch(rotated_rectangle);

//create elongated parking spots to be used for cutting island geometry.
	//workout length to add to the parking bay length.
	additional_length = bayWidth * DSCore.Math.Tan(bayAngle);
	//create the initial elongated spot.
	elongated_spot =
		Geometry.Rotate(
			Rectangle.ByWidthLength((bayLength+additional_length),bayWidth),
			startPoint,Vector.ZAxis(),bayAngle
			);
	//get bay start point.
	elongated_start = Autodesk.Curve.StartPoint(elongated_spot);
	//create plane at start point.
	start_plane = Plane.ByOriginNormal(elongated_start, Vector.ZAxis());
	//create coordinate system at the plane.
	bay_plane_cs = CoordinateSystem.ByPlane(start_plane);
	//transform bays onto centerline locations.
	transform_bays = Geometry.Transform (elongated_spot, bay_plane_cs, planeCS);
	//mirror bays along centerline.
	mirror_elongated_bays = Geometry.Mirror (transform_bays, mirror_plane);
	//combine pattern into one list.
	elongated_pattern = List.Join([transform_bays, mirror_elongated_bays]);
	//rotate the combined pattern.
	rotated_elongated_bays = Geometry.Rotate
		(elongated_pattern, rotation_point, Vector.ZAxis(), setout_angle);
	//rotate elongated bays for two-way parking.
	rotated_elongated_two_way = Geometry.Rotate
		(rotated_elongated_bays, rotation_point, Vector.ZAxis(), 180);
# ----------------------------------------

# group: Create interlocking parking pattern.
code_block_4 = CodeBlock(bayWidth=bayWidth, bayLength=bayLength, bayAngle=valueAtKey, bounding_curve_length=code_block_2, setout_angle=internalRotation)
# ---------- code_block_4.designscript (137 lines) ----------
//parameters.
bayWidth;
bayLength;
bayAngle;
bounding_curve_length;

//actual bay width against center line.
actualWidth = bayWidth / DSCore.Math.Cos(bayAngle);

//calculate number of bays for copying along line.
bay_copy_number = DSCore.Math.Ceiling(bounding_curve_length / actualWidth);

//create line.
line = Line.ByStartPointEndPoint(Autodesk.Point.ByCoordinates(),
Autodesk.Point.ByCoordinates(0,(actualWidth*bay_copy_number),0));

//get line start point coordinate system.
line_cs = Autodesk.Curve.CoordinateSystemAtParameter (line, 0);

//line start point coordinate system x axis.
cs_x_axis = line_cs.XAxis;

//create line to place first array of parking bays.
	//workout offset dimension.
	offset_dim = bayWidth * DSCore.Math.Sin(bayAngle) / 2;
	//move center line to offset bays.
	moved_line = Geometry.Translate (line, cs_x_axis, offset_dim);

//bay line location points.
locPoints = List.DropItems(Autodesk.Curve.PointAtParameter
	(moved_line,0..1..#bay_copy_number+1), -1);

//bay line plane.
linePlane = Plane.ByOriginNormal(locPoints,Vector.ZAxis());

//bay line plane coordinate system.
planeCS = CoordinateSystem.ByPlane(linePlane);

//line start point.
startPoint = Line.StartPoint(line);

//initial parking bay.
iniPark = Geometry.Rotate(Rectangle.ByWidthLength(bayLength,bayWidth),startPoint,
Vector.ZAxis(),bayAngle);

//bay start point.
bayStart = Autodesk.Curve.StartPoint(iniPark);

//bay plane.
bayPlane = Plane.ByOriginNormal(bayStart,Vector.ZAxis());

//bay coordinate system.
bayCS = CoordinateSystem.ByPlane(bayPlane);

//transform bays to line locations.
transBays = Geometry.Transform (iniPark,bayCS,planeCS);

//copy the transformed parking bays.
	//create the translation  axis.
	trans_axis = Vector.Rotate (cs_x_axis, Vector.ZAxis(), bayAngle);
	//copy the parking bays.
	copied_bays = Geometry.Translate (transBays, trans_axis, bayLength);

//combine bays into one list.
combined_bays = List.Join ([transBays, copied_bays]);

//mirror pattern.
	//create plane for mirroring.
	mirror_plane = Plane.ByOriginNormal (startPoint, cs_x_axis);
	//mirror bays.
	mirror_bays = Geometry.Mirror (combined_bays, mirror_plane);

//rotate combined pattern.
	//get rotation center point.
	rotation_point = line.PointAtParameter (0.5);
	//rotate bays type 1.
	rotated_bays1 = Geometry.Rotate
		(combined_bays, rotation_point, Vector.ZAxis(), setout_angle);
	//rotate bays type 2.
	rotated_bays2 = Geometry.Rotate
		(mirror_bays, rotation_point, Vector.ZAxis(), setout_angle);

//calculate overall pattern width.
	//width of the pattern from the center overlap zone.
	pattern_width_external = DSCore.Math.Cos(bayAngle) * bayLength;
	//calculate pattern width.
	pattern_width = pattern_width_external * 2 + offset_dim * 2;


///****elements for the creation of parking islands****///
//rotate center line.
rotated_center_line = Geometry.Rotate
	(line, rotation_point, Vector.ZAxis(), setout_angle);

//define rectangular surface covering full parking pattern.
	//create center plane.
	center_plane = Plane.ByOriginNormal
	(Autodesk.Curve.PointAtParameter(line, 0.5), Vector.ZAxis());
	//create the surface rectangle.
	surface_rectangle = Rectangle.ByWidthLength
		(center_plane, pattern_width, actualWidth*bay_copy_number);
	//rotate the rectangle.
	rotated_rectangle = Geometry.Rotate
		(surface_rectangle, rotation_point, Vector.ZAxis(), setout_angle);
	//create the pattern surface.
	pattern_surface = Autodesk.Surface.ByPatch(rotated_rectangle);

//create elongated parking spots to be used for cutting island geometry.
	//workout length to add to the parking bay length.
	additional_length = bayWidth * DSCore.Math.Tan(bayAngle);
	//create the initial elongated spot.
	elongated_spot =
		Geometry.Rotate(
			Rectangle.ByWidthLength((bayLength+additional_length),bayWidth),
			startPoint,Vector.ZAxis(),bayAngle
			);
	//get bay start point.
	elongated_start = Autodesk.Curve.StartPoint(elongated_spot);
	//create plane at start point.
	start_plane = Plane.ByOriginNormal(elongated_start, Vector.ZAxis());
	//create coordinate system at the plane.
	bay_plane_cs = CoordinateSystem.ByPlane(start_plane);
	//transform bays onto centerline locations.
	transform_bays = Geometry.Transform (elongated_spot, bay_plane_cs, planeCS);
	//copy the transformed parking bays.
	copy_bays = Geometry.Translate (
		transform_bays, trans_axis, (bayLength+additional_length)
		);
	//combine pattern into one list.
	elongated_pattern = List.Join([transform_bays, copy_bays]);
	//mirror the pattern.
	mirror_bays2 = Geometry.Mirror (elongated_pattern, mirror_plane);
	//rotate the combined pattern.
	rotated_elongated_bays = Geometry.Rotate
		(elongated_pattern, rotation_point, Vector.ZAxis(), setout_angle);
	rotated_elongated_bays2 = Geometry.Rotate
		(mirror_bays2, rotation_point, Vector.ZAxis(), setout_angle);
# ----------------------------------------

# group: Create herringbone parking pattern.
code_block_5 = CodeBlock(bayWidth=bayWidth, bayLength=bayLength, bounding_curve_length=code_block_2, setout_angle=internalRotation)
# ---------- code_block_5.designscript (134 lines) ----------
//parameters.
bayWidth;
bayLength;
bayAngle = 45;
bounding_curve_length;

//actual bay width against center line.
actualWidth = bayWidth / DSCore.Math.Cos(bayAngle);

//calculate number of bays for copying along line.
bay_copy_number = DSCore.Math.Ceiling(bounding_curve_length / actualWidth);

//create line.
line = Line.ByStartPointEndPoint(Autodesk.Point.ByCoordinates(),
Autodesk.Point.ByCoordinates(0,(actualWidth*bay_copy_number),0));

//get line start point coordinate system.
line_cs = Autodesk.Curve.CoordinateSystemAtParameter (line, 0);

//line start point coordinate system x axis.
cs_x_axis = line_cs.XAxis;

//create line to place first array of parking bays.
	//workout offset dimension.
	offset_dim = bayWidth * DSCore.Math.Sin(bayAngle) / 2;
	//move center line to offset bays.
	moved_line = Geometry.Translate (line, cs_x_axis, offset_dim);

//bay line location points.
locPoints = List.DropItems(Autodesk.Curve.PointAtParameter
	(moved_line,0..1..#bay_copy_number+1), -1);

//bay line plane.
linePlane = Plane.ByOriginNormal(locPoints,Vector.ZAxis());

//bay line plane coordinate system.
planeCS = CoordinateSystem.ByPlane(linePlane);

//line start point.
startPoint = Line.StartPoint(line);

//initial parking bay.
iniPark = Geometry.Rotate(Rectangle.ByWidthLength(bayLength,bayWidth),startPoint,
Vector.ZAxis(),bayAngle);

//bay start point.
bayStart = Autodesk.Curve.StartPoint(iniPark);

//bay plane.
bayPlane = Plane.ByOriginNormal(bayStart,Vector.ZAxis());

//bay coordinate system.
bayCS = CoordinateSystem.ByPlane(bayPlane);

//transform bays to line locations.
transBays = Geometry.Transform (iniPark,bayCS,planeCS);

//mirror parking bays along location line.
	//create plane for mirroring.
	mirror_plane = Plane.ByOriginNormal (startPoint, cs_x_axis);
	//mirror bays.
	mirror_bays = Geometry.Mirror (transBays, mirror_plane);

//move mirrored bays to form herringbone pattern.
moved_mirrored = Geometry.Translate (mirror_bays, line.Direction, actualWidth/2);

//combine bays into one list.
combined_bays = List.Join ([transBays, moved_mirrored]);

//rotate combined pattern.
	//get rotation center point.
	rotation_point = line.PointAtParameter (0.5);
	//rotate bays.
	rotated_bays = Geometry.Rotate
		(combined_bays, rotation_point, Vector.ZAxis(), setout_angle);

//rotate bays for two-way parking.
rotated_two_way = Geometry.Rotate
		(rotated_bays, rotation_point, Vector.ZAxis(), 180);

//calculate overall pattern width.
	//width of the pattern from the center overlap zone.
	pattern_width_external = DSCore.Math.Cos(45) * bayLength;
	//calculate pattern width.
	pattern_width = pattern_width_external * 2 + offset_dim * 2;

///****elements for the creation of parking islands****///
//rotate center line.
rotated_center_line = Geometry.Rotate
	(line, rotation_point, Vector.ZAxis(), setout_angle);

//define rectangular surface covering full parking pattern.
	//create center plane.
	center_plane = Plane.ByOriginNormal
	(Autodesk.Curve.PointAtParameter(line, 0.5), Vector.ZAxis());
	//create the surface rectangle.
	surface_rectangle = Rectangle.ByWidthLength
		(center_plane, pattern_width, actualWidth*bay_copy_number);
	//rotate the rectangle.
	rotated_rectangle = Geometry.Rotate
		(surface_rectangle, rotation_point, Vector.ZAxis(), setout_angle);
	//create the pattern surface.
	pattern_surface = Autodesk.Surface.ByPatch(rotated_rectangle);

//create elongated parking spots to be used for cutting island geometry.
	//workout length to add to the parking bay length.
	additional_length = bayWidth * DSCore.Math.Tan(45);
	elongated_spot =
		Geometry.Rotate(
			Rectangle.ByWidthLength((bayLength+additional_length),bayWidth),
			startPoint,Vector.ZAxis(),bayAngle
			);
	//get bay start point.
	elongated_start = Autodesk.Curve.StartPoint(elongated_spot);
	//create plane at start point.
	start_plane = Plane.ByOriginNormal(elongated_start, Vector.ZAxis());
	//create coordinate system at the plane.
	bay_plane_cs = CoordinateSystem.ByPlane(start_plane);
	//transform bays onto centerline locations.
	transform_bays = Geometry.Transform (elongated_spot, bay_plane_cs, planeCS);
	//mirror bays along centerline.
	mirror_elongated_bays = Geometry.Mirror (transform_bays, mirror_plane);
	//move mirrored bays to form herringbone pattern.
	moved_elongated_bays = Geometry.Translate (
		mirror_elongated_bays, line.Direction, actualWidth/2
		);
	//combine pattern into one list.
	elongated_pattern = List.Join([transform_bays, moved_elongated_bays]);
	//rotate the combined pattern.
	rotated_elongated_bays = Geometry.Rotate
		(elongated_pattern, rotation_point, Vector.ZAxis(), setout_angle);
	//rotate elongated bays for two-way parking.
	rotated_elongated_two_way = Geometry.Rotate
		(rotated_elongated_bays, rotation_point, Vector.ZAxis(), 180);
# ----------------------------------------

# group: Elongated parking rectangles. Used for cutting the green surfaces to create the island surfaces.
code_block_6 = CodeBlock(non_interlocking=code_block_3.rotated_elongated_bays, interlocked1=code_block_4.rotated_elongated_bays, interlocked2=code_block_4.rotated_elongated_bays2, herringbone=code_block_5.rotated_elongated_bays)
# ---------- code_block_6.designscript (5 lines) ----------
//parking pattern width selection numbers.
[1, 2, 3, 4];

//list of elongated parking rectangles.
[non_interlocking, interlocked1, interlocked2, herringbone];
# ----------------------------------------
string_from_object_3 = FromObject(object=code_block_6.out0)
byKeysValues_2 = DesignScript.Builtin.Dictionary.ByKeysValues(keys=[string_from_object_3, string_from_object_3], values=code_block_6.out1)
string_from_object_4 = FromObject(object=patternType)
valueAtKey_2 = DesignScript.Builtin.Dictionary.ValueAtKey(dictionary=byKeysValues_2, key=string_from_object_4)

# group: Parking green area surfaces.
code_block_7 = CodeBlock(non_interlocking=code_block_3.pattern_surface, interlocked1=code_block_4.pattern_surface, interlocked2=code_block_4.pattern_surface, herringbone=code_block_5.pattern_surface)
# ---------- code_block_7.designscript (5 lines) ----------
//parking pattern width selection numbers.
[1, 2, 3, 4];

//list of parking green area surfaces.
[non_interlocking, interlocked1, interlocked2, herringbone];
# ----------------------------------------
string_from_object_5 = FromObject(object=code_block_7.out0)
byKeysValues_3 = DesignScript.Builtin.Dictionary.ByKeysValues(keys=[string_from_object_5, string_from_object_5], values=code_block_7.out1)
string_from_object_6 = FromObject(object=patternType)
valueAtKey_3 = DesignScript.Builtin.Dictionary.ValueAtKey(dictionary=byKeysValues_3, key=string_from_object_6)

# group: Replacement elongated parking rectangles. For replacements as required to account for 1-way or 2-way traffic between rows.
code_block_8 = CodeBlock(non_interlocking=code_block_3.rotated_elongated_two_way, interlocked1=code_block_4.rotated_elongated_bays2, interlocked2=code_block_4.rotated_elongated_bays, herringbone=code_block_5.rotated_elongated_two_way)  # same code as code_block_6
string_from_object_7 = FromObject(object=code_block_8.out0)
byKeysValues_4 = DesignScript.Builtin.Dictionary.ByKeysValues(keys=[string_from_object_7, string_from_object_7], values=code_block_8.out1)
string_from_object_8 = FromObject(object=patternType)
valueAtKey_4 = DesignScript.Builtin.Dictionary.ValueAtKey(dictionary=byKeysValues_4, key=string_from_object_8)

# group: Parking bay pattern widths.
code_block_9 = CodeBlock(non_interlocking=code_block_3.pattern_width, interlocked1=code_block_4.pattern_width, interlocked2=code_block_4.pattern_width, herringbone=code_block_5.pattern_width)
# ---------- code_block_9.designscript (5 lines) ----------
//parking pattern width selection numbers.
[1, 2, 3, 4];

//list of parking patterns.
[non_interlocking, interlocked1, interlocked2, herringbone];
# ----------------------------------------
string_from_object_9 = FromObject(object=code_block_9.out0)
byKeysValues_5 = DesignScript.Builtin.Dictionary.ByKeysValues(keys=[string_from_object_9, string_from_object_9], values=code_block_9.out1)
string_from_object_10 = FromObject(object=patternType)
valueAtKey_5 = DesignScript.Builtin.Dictionary.ValueAtKey(dictionary=byKeysValues_5, key=string_from_object_10)

# group: Parking bay pattern selection.
code_block_10 = CodeBlock(non_interlocking=code_block_3.rotated_bays, interlocked1=code_block_4.rotated_bays1, interlocked2=code_block_4.rotated_bays2, herringbone=code_block_5.rotated_bays)
# ---------- code_block_10.designscript (5 lines) ----------
//parking pattern selection numbers.
[1, 2, 3, 4];

//list of parking patterns.
[non_interlocking, interlocked1, interlocked2, herringbone];
# ----------------------------------------
string_from_object_11 = FromObject(object=code_block_10.out0)
byKeysValues_6 = DesignScript.Builtin.Dictionary.ByKeysValues(keys=[string_from_object_11, string_from_object_11], values=code_block_10.out1)
string_from_object_12 = FromObject(object=patternType)
valueAtKey_6 = DesignScript.Builtin.Dictionary.ValueAtKey(dictionary=byKeysValues_6, key=string_from_object_12)

# group: Replacement parking bay pattern selection. For replacements as required to account for 1-way or 2-way traffic between rows.
code_block_11 = CodeBlock(non_interlocking=code_block_3.rotated_two_way, interlocked1=code_block_4.rotated_bays2, interlocked2=code_block_4.rotated_bays1, herringbone=code_block_5.rotated_two_way)  # same code as code_block_10
string_from_object_13 = FromObject(object=code_block_11.out0)
byKeysValues_7 = DesignScript.Builtin.Dictionary.ByKeysValues(keys=[string_from_object_13, string_from_object_13], values=code_block_11.out1)
string_from_object_14 = FromObject(object=patternType)
valueAtKey_7 = DesignScript.Builtin.Dictionary.ValueAtKey(dictionary=byKeysValues_7, key=string_from_object_14)

# group: Outputs
elongatedParkingPatterns = Output(valueAtKey_2)  # the elongated parking patterns for cutting the green surfaces.
greenAreaSurfaces = Output(valueAtKey_3)  # the full green area surfaces before cutting.
replacementElongatedPattern = Output(valueAtKey_4)  # for pattern replacements as required to account for 1-way or 2-way traffic between rows. Used for cutting the green surfaces.
patternWidth = Output(valueAtKey_5)  # the overall width of the parking pattern.
patternCenterLine = Output(code_block_3.line)  # the pattern center line.
parkingPattern = Output(valueAtKey_6)  # the parking pattern.
replacementPattern = Output(valueAtKey_7)  # for pattern replacements as required to account for 1-way or 2-way traffic between rows.
