# Dynamo custom node InternalBaysZonesRoutes.dyf (Dynamo 3.3.0.6316)
# category: Feasibility.Parking
# Creates internal parking bays and allows the delineation of movement routes within the parking layout.

# group: Inputs.
perimeterCurves = Input(perimeterCurves: var[]..[])  # the perimeter curves of the parking layout.
bayLength = Input(bayLength: double = 5)  # the length of the vehicular parking bays.
perimeterAisleWidth = Input(perimeterAisleWidth: double = 7)  # the width of the perimeter aisle all round the parking layout.
concaveCornerRadius = Input(concaveCornerRadius: double = 3.5)  # The vehicle turning radius at the concave corners of the perimeter aisle.
convexCornerRadius = Input(convexCornerRadius: double = 5)  # The vehicle turning radius at the convex corners of the perimeter aisle.
exclusionZone = Input(exclusionZone: var[]..[])  # surface geometry representing the exclusion zones.
zoneParkingType = Input(zoneParkingType: int = 1)  # select "1" for regular 90 degree parking along the perimeter of the exclusion area, and "2" for parallel parking.
bayWidth = Input(bayWidth: double = 2.5)  # the width of the vehicular parking bays.
zoneWalkwayWidth = Input(zoneWalkwayWidth: double = 1.5)  # the width of the walkway along the perimeter of the building and green zones.
exclusionZoneAisleWidth = Input(exclusionZoneAisleWidth: double = 7)  # the width of the exclusion zone perimeter aisle.
axialRouteCurves = Input(axialRouteCurves: var[]..[])  # lines to define the driving routes of the internal parking area.
axialRouteWidth = Input(axialRouteWidth: double = 7)  # the width of the axial routes of the internal parking area.
greenAreaSurfaces = Input(greenAreaSurfaces: Autodesk.DesignScript.Geometry.Surface)  # the full green area surfaces before cutting. Feed from the generate patterns node.
patternCenterLine = Input(patternCenterLine: var)  # the pattern center line. Feed from the generate patterns node.
boundingRectangle = Input(boundingRectangle: Autodesk.DesignScript.Geometry.PolyCurve)  # the bounding rectangle of the internal parking surface. Feed from the generate bounding rectangle node.
patternWidth = Input(patternWidth: double)  # the overall width of the parking pattern. Feed from the generate patterns node.
patternAngle = Input(patternAngle: int = 1)  # select "1" for 30 degree parking, "2" for 45 degree parking, "3" for 60 degree parking, and "4" for 90 degree parking. Note that the angles are not applied to the perimeter parking bays and herringbone pattern. The herringbone pattern will always be at 45 degrees.
aisleTypeSelector = Input(aisleTypeSelector: int = 1)  # select "1" for one way traffic, and "2" for two way traffic. The one way aisle is 4400mm wide and the two way aisle is 5400mm wide. The aisle width will be 7000mm for one way and two way if the parking bay angle is 90 degrees.
oneWayAisleWidth = Input(oneWayAisleWidth: double = 4.4)  # the width of the one way aisle between the parking rows.
twoWayAisleWidth = Input(twoWayAisleWidth: double = 5.4)  # the width of the two way aisle between the parking rows.
islandCornerRadius = Input(islandCornerRadius: double = 1)  # the radius at the corners of the internal parking islands.
elongatedParkingPatterns = Input(elongatedParkingPatterns: var[]..[])  # the elongated parking patterns for cutting the green surfaces. Feed from the generate patterns node.
replacementElongatedPattern = Input(replacementElongatedPattern: var[]..[])  # for pattern replacements as required to account for 1-way or 2-way traffic between rows. Used for cutting the green surfaces. Feed from the generate patterns node.
patternType = Input(patternType: int = 1)  # select "1" for the non interlocking pattern which allows for an island between the bay rows, "2" for the interlocking pattern, "3" for the mirrored interlocking pattern, and "4" for the herringbone pattern.
parkingPattern = Input(parkingPattern: var[]..[])  # the parking pattern. Feed from the generate patterns node.
replacementPattern = Input(replacementPattern: var[]..[])  # for pattern replacements as required to account for 1-way or 2-way traffic between rows. Feed from the generate patterns node.

# group: Create full parking area surface.
# note: Create a continuous curve from the surface edge curves.
byJoinedCurves = PolyCurve.ByJoinedCurves(curves=perimeterCurves)
# note: Create a surface covering the full parking boundary.
byPatch = Surface.ByPatch(closedCurve=byJoinedCurves)

code_block = CodeBlock(polycurve=byJoinedCurves) { polycurve[0]; }

# group: Create internal parking area surface.
# note: Here we add the aisle width and parking bay length to offset the external boundary of the parking area.
code_block_2 = CodeBlock(parking_bay_length=bayLength, aisle_width=perimeterAisleWidth) { -(parking_bay_length + aisle_width); }
# note: Offset the perimeter boundary to create the internal surface for the internal parking spots. Use a while loop to keep one single curve loop if the user offset results in multiple loops.
python_script = Python(IN[0]=code_block, IN[1]=code_block_2)  # CPython3
# ---------- python_script.python (33 lines) ----------
# Import the required libraries.
import clr
clr.AddReference('ProtoGeometry')
from Autodesk.DesignScript.Geometry import *

# Inputs.
site_curve = IN[0]
offset_distance = IN[1]

# Offset the boundary curve.
# Return the polycurve to singular curve if the user input offset returns two curves.
current_offset = offset_distance
increment_value = 0.1
max_attempts = 1000
attempts = 0

while attempts < max_attempts:
    offset_curve = Curve.OffsetMany(site_curve, current_offset, Vector.ZAxis())
    
    # Check if the offset curve list has more than one curve loop:
    if len(offset_curve) == 1:
        returned_curve = offset_curve
        break
    else:
        # Reduce the offset and try again
        current_offset += increment_value  # Adding to the negative value
        attempts += 1

# Check if a valid offset curve was found:
if 'returned_curve' not in locals():
    raise Exception("Could not reduce the curve offset to one loop after multiple attempts")

OUT = returned_curve
# ----------------------------------------
# note: Fillet (round) the convex corners of the internal parking surface with the vehicle turning radii parameter. Return the original polycurve if the fillet cannot be achieved.
python_script_2 = Python(IN[0]=python_script, IN[1]=concaveCornerRadius, IN[2]=convexCornerRadius)  # CPython3
# ---------- python_script_2.python (25 lines) ----------
# Import the required libraries.
import clr
clr.AddReference('ProtoGeometry')
from Autodesk.DesignScript.Geometry import *

# Inputs.
polycurve = IN[0]
internal_fillet_radius = IN[1]
external_fillet_radius = IN[2]

# Add internal fillet to polycurve. Return original if unsuccessful.
try:
    internal_fillet_curve = PolyCurve.Fillet(polycurve[0], internal_fillet_radius, False)
except:
    internal_fillet_curve = polycurve


# Add external fillet to polycurve. Return internal fillet curve if unsuccessful.   
try:
    external_fillet_curve = PolyCurve.Fillet(internal_fillet_curve, external_fillet_radius, True)
except:
    external_fillet_curve = internal_fillet_curve


OUT = external_fillet_curve
# ----------------------------------------
# note: Create the internal parking surface.
byPatch_2 = Surface.ByPatch(closedCurve=python_script_2)

# group: Get boundary of exclusion zone.
flatten = List.Flatten(list=exclusionZone)
# note: Get the perimeter curves of the surface.
perimeterCurves_2 = Surface.PerimeterCurves(surface=flatten)
# note: Join the projected curves into one polycurve.
byJoinedCurves_2 = PolyCurve.ByJoinedCurves(curves=perimeterCurves_2)

# group: Offset the exclusion area perimeter curves.
code_block_3 = CodeBlock(length_selector=zoneParkingType, regular_length=bayLength, parallel_length=bayWidth, walkway_width=zoneWalkwayWidth, exclusion_perimeter_route_width=exclusionZoneAisleWidth)
# ---------- code_block_3.designscript (6 lines) ----------
//conditional statement to choose between parallel or regular parking lengths.
parking_length = length_selector == 1? regular_length: parallel_length;

//add the parking length and walkway width to the exclusion zone
//perimeter aisle width to offset the exclusion area.
walkway_width + parking_length + exclusion_perimeter_route_width;
# ----------------------------------------
code_block_4 = CodeBlock { Vector.ZAxis(); }
# note: Offset the exclusion area perimeter curves accounting for the parking length and roadway width.
offsetMany = Curve.OffsetMany(curve=byJoinedCurves_2, signedDistance=code_block_3.out1, planeNormal=code_block_4)
code_block_5 = CodeBlock { false; }
# note: Round the corners of the offset exclusion area curve by the car external turning radius.
fillet = PolyCurve.Fillet(polyCurve=offsetMany, radius=convexCornerRadius, clockwise_corners=code_block_5)

# group: Combine the exclusion zone surfaces into one surface.
byPatch_3 = Surface.ByPatch(closedCurve=fillet)
byUnion = Surface.ByUnion(surfaces=byPatch_3)

# group: Subtract exclusion areas from the internal parking surface.
difference = Surface.Difference(surface=byPatch_2, others=byPatch_3)

# group: Create axial route surfaces.
code_block_6 = CodeBlock(axial_route_width=axialRouteWidth)
# ---------- code_block_6.designscript (2 lines) ----------
// divide the width by 100 to account for bug in node.
axial_route_width;
# ----------------------------------------
code_block_7 = CodeBlock { Vector.ZAxis(); }
byThickeningCurveNormal = PolyCurve.ByThickeningCurveNormal(curve=axialRouteCurves, thickness=code_block_6, normal=code_block_7)
byPatch_4 = Surface.ByPatch(closedCurve=byThickeningCurveNormal)

byUnion_2 = Surface.ByUnion(surfaces=byPatch_4)

# group: Subtract axial routes from the internal parking surface.
difference_2 = Surface.Difference(surface=difference, others=byUnion_2)

# group: Aisle width selection.
# note: The python script is designed to calculate the aisle width between internal parking rows. This width is determined based on the angle of the rows and whether the aisle is one-way or two-way.
python_script_3 = Python(IN[0]=patternAngle, IN[1]=aisleTypeSelector, IN[2]=oneWayAisleWidth, IN[3]=twoWayAisleWidth, IN[4]=perimeterAisleWidth)  # CPython3
# ---------- python_script_3.python (19 lines) ----------
# Inputs
# Input to select between 45, 60 and 90 degree parking bays. 
angle_selector = IN[0]
# Input to select between a one-way or two-way aisle. 
aisle_type_selector = IN[1]
# one-way and two way aisle width inputs.
one_way_width = IN[2]
two_way_width = IN[3]
perimeter_width = IN[4]

# provide the aisle width as per the selected angle and aisle type.
if angle_selector != 4 and aisle_type_selector == 1:
    aisle_width = one_way_width 
elif angle_selector != 4 and aisle_type_selector == 2:
    aisle_width = two_way_width 
else:
    aisle_width = perimeter_width
    
OUT = aisle_width
# ----------------------------------------

# group: Create parking setout lines.
# note: Get the edge curves of the internal parking bay bounding rectangle.
curves = PolyCurve.Curves(polyCurve=boundingRectangle)
code_block_8 = CodeBlock(curve=curves) { curve[3]; }
# note: Here we get the bounding rectangle curves that are opposite each other.
code_block_9 = CodeBlock(curve=curves) { curve[1]; }
code_block_10 = CodeBlock(pattern_width=patternWidth) { pattern_width/2; }
# note: Here we use the width of the parking pattern to setout the first point along the selected bounding rectangle curves.
pointAtChordLength = Curve.PointAtChordLength(curve=code_block_9, chordLength=code_block_10)
code_block_11 = CodeBlock(pattern_width=patternWidth, aisle_width=python_script_3) { pattern_width + aisle_width; }
# note: Here we use the pattern width plus the aisle width to set the location points of the pattern.
pointsAtChordLengthFromPoint = Curve.PointsAtChordLengthFromPoint(curve=code_block_9, point=pointAtChordLength, chordLength=code_block_11)
# note: Transfer the points from the first line to the second.
closestPointTo = Geometry.ClosestPointTo(geometry=code_block_8, other=pointsAtChordLengthFromPoint)
list_create = List.Create(item0=closestPointTo, item1=pointsAtChordLengthFromPoint)
# note: Pair the points in the first and second list.
transpose = List.Transpose(lists=list_create)
# note: Create setout lines for the internal parking bays by connecting the paired points.
byPoints = PolyCurve.ByPoints(points=transpose)
code_block_12 = CodeBlock { 0; }
# note: Remove the first unrequired point from the list.
removeItemAtIndex = List.RemoveItemAtIndex(list=pointsAtChordLengthFromPoint, indices=code_block_12)

# group: Transform parking bays to parking area.
# note: Get the pattern center line. To be used as a reference for transforming the bays onto the parking layout.
code_block_13 = CodeBlock(pattern_center_line=patternCenterLine) { pattern_center_line; }
code_block_14 = CodeBlock { 0.5; }
# note: Get the center point of the pattern center line.
pointAtParameter = Curve.PointAtParameter(curve=code_block_13, param=code_block_14)
# note: Create a plane at the center point.
byOriginNormal = Plane.ByOriginNormal(origin=pointAtParameter)
byPlane = CoordinateSystem.ByPlane(plane=byOriginNormal)
code_block_15 = CodeBlock { 0.5; }
# note: Get the center points of the internal parking setout lines.
pointAtParameter_2 = Curve.PointAtParameter(curve=byPoints, param=code_block_15)
# note: Create a plane at the center points.
byOriginNormal_2 = Plane.ByOriginNormal(origin=pointAtParameter_2)
# note: Create coordinate systems at the planes.
byPlane_2 = CoordinateSystem.ByPlane(plane=byOriginNormal_2)
# note: We replicate the original parking pattern onto the setout lines of the internal parking bays. This transformation utilizes the coordinate system established at the centerline of the pattern, aligning it with the centerline of the setout lines.
transform = Geometry.Transform(geometry=parkingPattern, fromCoordinateSystem=byPlane, contextCoordinateSystem=byPlane_2, lacing=CrossProduct)

# group: Adjust regular pattern as required for 1-way and 2-way aisles.
transpose_2 = List.Transpose(lists=transform)
# note: In this step, we employ a Python script to tailor the pattern to suit a one-way or a two-way aisle, depending on the chosen parking pattern.
replaceItemAtIndex = Python(IN[0]=transpose_2, IN[1]=replacementPattern, IN[2]=patternType, IN[3]=aisleTypeSelector, IN[4]=byPlane_2, IN[5]=byPlane)  # "List.ReplaceItemAtIndex"; CPython3
# ---------- replaceItemAtIndex.python (67 lines) ----------
# Load the Python Standard and DesignScript Libraries
import sys
import clr
clr.AddReference('ProtoGeometry')
from Autodesk.DesignScript.Geometry import *
clr.AddReference('GeometryColor')
from Modifiers import GeometryColor
clr.AddReference('DSCoreNodes') 
import DSCore
from DSCore import *


# Inputs.
original_parking_list = IN[0]
enumerated_parking_list = enumerate(original_parking_list)
replacement_parking_pattern = IN[1]
# "1" for non interlocking, "2" for interlocking, "3" for mirrored interlocking and "4" for herringbone.
parking_pattern_type = IN[2]
# "1" for 1-way aisle and "2" for 2-way aisle.
aisle_type = IN[3]
context_coordinate_system = IN[4]
original_coordinate_system = IN[5]

# Copy of the original parking list.
copy_list = original_parking_list[:]


# Replace items in parking list.

# Keep the parking list as is if the aisle is one-way and the pattern type is non interlocking.
if aisle_type == 1 and parking_pattern_type == 1:
    copy_list = copy_list
# Replace every second row with the replacement pattern if the aisle is two-way and pattern type is non interlocking.
elif aisle_type == 2 and parking_pattern_type == 1:
    for index, item in enumerate(original_parking_list):
        parking_bays = []
        if index % 2 == 1:
            for parking in replacement_parking_pattern:
                parking_bays.append(Geometry.Transform(parking, original_coordinate_system, context_coordinate_system[index]))
                copy_list[index] = parking_bays
# Replace every second row with the replacement pattern if the aisle is one-way and pattern type is interlocking.
elif aisle_type == 1 and parking_pattern_type == 2:
    for index, item in enumerate(original_parking_list):
        parking_bays = []
        if index % 2 == 1:
            for parking in replacement_parking_pattern:
                parking_bays.append(Geometry.Transform(parking, original_coordinate_system, context_coordinate_system[index]))
                copy_list[index] = parking_bays
# Replace every second row with the replacement pattern if the aisle is one-way and pattern type is mirrored interlocking.
elif aisle_type == 1 and parking_pattern_type == 3:
    for index, item in enumerate(original_parking_list):
        parking_bays = []
        if index % 2 == 1:
            for parking in replacement_parking_pattern:
                parking_bays.append(Geometry.Transform(parking, original_coordinate_system, context_coordinate_system[index]))
                copy_list[index] = parking_bays
# Replace every second row with the replacement pattern if the aisle is two-way and pattern type is herringbone.
elif aisle_type == 2 and parking_pattern_type == 4:
    for index, item in enumerate(original_parking_list):
        parking_bays = []
        if index % 2 == 1:
            for parking in replacement_parking_pattern:
                parking_bays.append(Geometry.Transform(parking, original_coordinate_system, context_coordinate_system[index]))
                copy_list[index] = parking_bays
                
              
OUT = copy_list
# ----------------------------------------

# group: Create perimeter roadway surface.
# note: Subtract the internal parking surface from the larger parking area surface.
difference_3 = Surface.Difference(surface=byPatch, others=byPatch_2)

# group: Subtract exclusion areas from the perimeter roadway surface.
difference_4 = Surface.Difference(surface=difference_3, others=byPatch_3)

# group: Combine axial routes, perimeter roadway and exclusion area surfaces.
join = List.Join(list0=difference_4, list1=byPatch_4, list2=byUnion)
# note: This polysurface will be used downstream to remove any parking bays that intersect with the primary roadways (axial, perimeter and exclusion areas).
byJoinedSurfaces = PolySurface.ByJoinedSurfaces(surfaces=join)
byUnion_3 = Surface.ByUnion(surfaces=byJoinedSurfaces)

# group: Filter for the parking bays intersecting with the middle parking area and not intersecting with the roadway.
# note: Create a boolean list to be used in sorting the parking bays that intersect with the internal parking area.
doesIntersect = Geometry.DoesIntersect(geometry=difference_2, other=replaceItemAtIndex)
# note: Use the boolean list to sort the internal parking bays.
filterByBoolMask = List.FilterByBoolMask(list=replaceItemAtIndex, mask=doesIntersect)
code_block_16 = CodeBlock { false; }
clean = List.Clean(list=filterByBoolMask.in, preserveIndices=code_block_16)
# note: We generate a boolean list designed to identify and remove any parking bays that intersect with the perimeter aisle, axial routes and exclusion area roadway.
doesIntersect_2 = Geometry.DoesIntersect(geometry=byUnion_3, other=clean)
# note: Use the generated boolean list to sort the parking spots that intersect with the perimeter aisle, axial routes and exclusion area roadway.
filterByBoolMask_2 = List.FilterByBoolMask(list=clean, mask=doesIntersect_2)
# note: Retrieve the filtered internal parking bays.
code_block_17 = CodeBlock(internal_parking_spots=filterByBoolMask_2.out) { internal_parking_spots; }

# group: Create the internal green area surfaces at parking rows.
# note: We replicate the original parking green surfaces onto the setout lines of the internal parking bays. This transformation utilizes the coordinate system established at the centerline of the pattern, aligning it with the centerline of the setout lines.
transform_2 = Geometry.Transform(geometry=greenAreaSurfaces, fromCoordinateSystem=byPlane, contextCoordinateSystem=byPlane_2, lacing=CrossProduct)
# note: Join the transformed green space rectangular surfaces into one polysurface.
byJoinedSurfaces_2 = PolySurface.ByJoinedSurfaces(surfaces=transform_2)
# note: Intersect the green space surfaces with the internal parking area surface.
intersect = Geometry.Intersect(geometry=difference_2, other=byJoinedSurfaces_2)
# note: Get the perimeter curves of the intersected green space surfaces.
perimeterCurves_3 = Surface.PerimeterCurves(surface=intersect)
# note: Join the perimeter curves to form closed loops of polycurves.
byJoinedCurves_3 = PolyCurve.ByJoinedCurves(curves=perimeterCurves_3)
# note: Fillet (round) the corners of the curve. Return the original polycurve if the fillet cannot be achieved.
python_script_4 = Python(IN[0]=byJoinedCurves_3, IN[1]=islandCornerRadius, IN[2]=islandCornerRadius)  # CPython3
# ---------- python_script_4.python (44 lines) ----------
# Import the required libraries.
import clr
clr.AddReference('ProtoGeometry')
from Autodesk.DesignScript.Geometry import *


# Inputs.
polycurves = IN[0]
internal_fillet_radius = IN[1]
external_fillet_radius = IN[2]


# Add internal fillet to polycurve. Return original if unsuccessful.
try:
    internal_fillet_curves = []
    for polycurve in polycurves: 
        # Return the filleted polycurve if successful.
        try:
            internal_fillet_curves.append(PolyCurve.Fillet(polycurve, internal_fillet_radius, False))
        # Return the original polycurve if unsuccessful.
        except:
            internal_fillet_curves.append(polycurve)
except:
    # Return the original polycurve list if the fillet process is unsuccessful.
    internal_fillet_curves = polycurves



# Add external fillet to polycurve. Return internal fillet curve if unsuccessful.   
try:
    external_fillet_curves = []
    for polycurve in internal_fillet_curves:
        # Return the filleted polycurve if successful.
        try:
            external_fillet_curves.append(PolyCurve.Fillet(polycurve, external_fillet_radius, True))
        # Return the original polycurve if unsuccessful.
        except:
            external_fillet_curves.append(polycurve)
except:
    # Return the internal fillet curves list if the fillet process is unsuccessful.
    external_fillet_curves = internal_fillet_curves 


OUT = external_fillet_curves
# ----------------------------------------
# note: Create a surface from the rounded polycurves.
byPatch_5 = Surface.ByPatch(closedCurve=python_script_4)
# note: Combine the rounded surfaces into a singular polysurface.
byJoinedSurfaces_3 = PolySurface.ByJoinedSurfaces(surfaces=byPatch_5)
# note: Transform the elongated parking bays to be used for cuttin the green island surfaces onto the parking area.
transform_3 = Geometry.Transform(geometry=elongatedParkingPatterns, fromCoordinateSystem=byPlane, contextCoordinateSystem=byPlane_2, lacing=CrossProduct)
transpose_3 = List.Transpose(lists=transform_3)
# note: In this step, we employ a Python script to tailor the pattern to suit a one-way or a two-way aisle, depending on the chosen parking pattern.
replaceItemAtIndex_2 = Python(IN[0]=transpose_3, IN[1]=replacementElongatedPattern, IN[2]=patternType, IN[3]=aisleTypeSelector, IN[4]=byPlane_2, IN[5]=byPlane)  # "List.ReplaceItemAtIndex"; CPython3; same code as replaceItemAtIndex
code_block_18 = CodeBlock { -0.1; }
offsetMany_2 = Curve.OffsetMany(curve=code_block_17, signedDistance=code_block_18)
# note: Create surfaces from the internal parking spots.
byPatch_6 = Surface.ByPatch(closedCurve=offsetMany_2)
flatten_2 = List.Flatten(list=byPatch_6)
# note: Combine the parking spot surfaces into a singular polysurface.
byJoinedSurfaces_4 = PolySurface.ByJoinedSurfaces(surfaces=flatten_2)
# note: Create surfaces from the elongated parking spots.
byPatch_7 = Surface.ByPatch(closedCurve=replaceItemAtIndex_2)
# note: Create a boolean list to sort the elongated parking spots that intersect the regular parking bays.
doesIntersect_3 = Geometry.DoesIntersect(geometry=byJoinedSurfaces_4, other=byPatch_7)
# note: Filter the elongated bays that intersect with the regular parking spots.
filterByBoolMask_3 = List.FilterByBoolMask(list=replaceItemAtIndex_2, mask=doesIntersect_3)
byPatch_8 = Surface.ByPatch(closedCurve=filterByBoolMask_3.in)
code_block_19 = CodeBlock { false; }
clean_2 = List.Clean(list=byPatch_8, preserveIndices=code_block_19)
flatten_3 = List.Flatten(list=clean_2)
# note: Combine the surfaces into one polysurface.
byJoinedSurfaces_5 = PolySurface.ByJoinedSurfaces(surfaces=flatten_3)
# note: Create the internal island surfaces by subtracting the elongated parking bays from the intersected island surface.
difference_5 = Surface.Difference(surface=byJoinedSurfaces_3, others=byJoinedSurfaces_5)

flatten_4 = List.Flatten(list=code_block_17)

# group: Workout angles for rotation of the placed internal parking spots.
curves_2 = PolyCurve.Curves(polyCurve=flatten_4)
code_block_20 = CodeBlock { 1; }
getItemAtIndex = List.GetItemAtIndex(list=curves_2@L2, index=code_block_20)
direction = Line.Direction(line=getItemAtIndex)
reverse = Vector.Reverse(vector=direction)
code_block_21 = CodeBlock { Vector.YAxis(); }
code_block_22 = CodeBlock { Vector.ZAxis(); }
angleAboutAxis = Vector.AngleAboutAxis(vector=reverse, otherVector=code_block_21, rotationAxis=code_block_22)

# group: Outputs
islandSurfaces = Output(difference_5)  # island surfaces not covered by parking.
boundarySurface = Output(byPatch)  # the input surface defining the full parking area.
perimeterRoadwaySurface = Output(difference_3)  # a surface covering the length of the perimeter spots and the width of the perimeter aisle.
parkingSpots = Output(flatten_4)  # rectangles representing the internal parking spots.
perimeterCurve = Output(byJoinedCurves)  # the closed perimeter curve of the parking layout.
exclusionZone_2 = Output(byUnion)  # "exclusionZone"; exclusion zone surfaces combined into one surface.
rotationAngle = Output(angleAboutAxis)  # the rotation angle for the parking bays loaded into the Revit model.

# group: Rotate elongated non-interlocking parking pattern.
ZAxis = Vector.ZAxis()
code_block_23 = CodeBlock { 180; }
# note: Should the need arise for two-way angled parking in a non-interlocking parking pattern, we rotate the original parking pattern by 180 degrees to be used for substitutions.
rotate = Geometry.Rotate(geometry=elongatedParkingPatterns, origin=pointAtParameter, axis=ZAxis, degrees=code_block_23)
