# Dynamo custom node ProjectBoundaryOntoPlane.dyf (Dynamo 3.3.0.6316)
# category: Feasibility.Parking
# To project the boundaries developed from selected faces onto a plane.

# group: Inputs
boundarySurface = Input(boundarySurface: Autodesk.DesignScript.Geometry.Surface)  # the input surface defining the parking area.
siteLevel = Input(siteLevel: Revit.Elements.Level)  # the site base level.

# group: Pull the site boundary onto the required level.
perimeterCurves = Surface.PerimeterCurves(surface=boundarySurface)
# note: Get the level's plane.
# From the Genius Loci package.
level_plane = Python(IN[0]=siteLevel)  # CPython3
# ---------- level_plane.python (24 lines) ----------
#Alban de Chasteigner 2020
#twitter : @geniusloci_bim
#geniusloci.bim@gmail.com

import clr
clr.AddReference('RevitAPI')
import Autodesk
from Autodesk.Revit.DB import *

clr.AddReference('RevitNodes')
import Revit
clr.ImportExtensions(Revit.GeometryConversion)

levels = UnwrapElement(IN[0]) if isinstance(IN[0],list) else [UnwrapElement(IN[0])]
	
planes = []
for level in levels:
	elev=level.ProjectElevation
	point=XYZ(0,0,elev)
	planes.append(Plane.CreateByNormalAndOrigin(XYZ.BasisZ,point).ToPlane())

	
if isinstance(IN[0], (list)): OUT = planes
else: OUT = planes[0]
# ----------------------------------------
pullOntoPlane = Curve.PullOntoPlane(curve=perimeterCurves, plane=level_plane)
byJoinedCurves = PolyCurve.ByJoinedCurves(curves=pullOntoPlane)

# group: Output
PolyCurve = Output(byJoinedCurves)
Plane = Output(level_plane)
