# Dynamo graph Scenario 1_perimeter_internal_zones_routes.dyn (Dynamo 3.3.0.6316)
# packages: Feasibility 2025.8.11

# group: Inputs
# note: The vehicle turning radius at the convex corners of the perimeter aisle.
in_external_turning_radius = DoubleSlider(5, range=5..10 step 0.1)  # graph input
# note: The vehicle turning radius at the concave corners of the perimeter aisle.
in_internal_turning_radius = DoubleSlider(3.5, range=3.5..10 step 0.1)  # graph input
# note: Define the parking region with a filled region.
in_select_parking_region = DSFaceSelection()  # 1 picked in the model; graph input
# note: Select the level to host the parking bays.
in_select_parking_level = Levels("Level 0")  # graph input
# note: The length of the parking bays.
in_parking_bay_length = DoubleSlider(5, range=0.5..10 step 0.1)  # graph input
# note: The width of the perimeter aisle for the overall parking layout.
in_perimeter_aisle_width = DoubleSlider(7, range=7..10 step 0.1)  # graph input
# note: The distance between the parking bays at the convex corners.
in_parking_bay_convex_corner = DoubleSlider(2, range=0.3..5 step 0.1)  # "IN_Parking Bay Convex Corner Spacing"; graph input
# note: The distance between the parking bays at the concave corners.
in_parking_bay_concave_corner = DoubleSlider(0.5, range=0.5..10 step 0.1)  # "IN_Parking Bay Concave Corner Spacing"; graph input
# note: Select "1" for regular 90 degree parking along the perimeter of the exclusion area, and "2" for parallel parking.
in_exclusion_area_parking_type = IntegerSlider(1, range=1..2 step 1)  # graph input
# note: The width of the walkway along the perimeter of the exclusion zone.
in_exclusion_zone_walkway_width = DoubleSlider(1, range=0..3 step 0.1)  # graph input
# note: The width of the parking bays.
in_parking_bay_width = DoubleSlider(2.5, range=0.5..5 step 0.1)  # graph input
# note: Establish the non-parking areas within the parking lot for building by designating them as filled regions. These regions are spaces where parking will not be permitted.
in_select_building_zones = SelectFaces()  # 1 picked in the model; graph input
# note: The width of the exclusion zone perimeter aisle.
in_exclusion_zone_aisle_width = DoubleSlider(7, range=7..10 step 0.1)  # graph input
# note: Select "1" for 45 degree parking, "2" for 60 degree parking, and "3" for 90 degree parking. Note that the angles are not applied to the perimeter parking bays and herringbone pattern. The herringbone pattern will always be at 45 degrees.
in_parking_angle_selector = IntegerSlider(4, range=1..4 step 1)  # graph input
# note: Select "1" for the non interlocking pattern which allows for an island between the bay rows, "2" for the interlocking pattern, "3" for the mirrored interlocking pattern, and "4" for the herringbone pattern.
in_parking_pattern_selector = IntegerSlider(3, range=1..4 step 1)  # graph input
# note: The width of the island between the non interlocking parking pattern.
in_parking_island_width = DoubleSlider(1, range=0.5..2 step 0.1)  # graph input
# note: The rotation angle of the setout line of the center bays.
in_bay_setout_line_rotation = DoubleSlider(0, range=0..360 step 1)  # graph input
# note: Select "1" for one way traffic, and "2" for two way traffic.
in_aisle_type_selector = IntegerSlider(2, range=1..2 step 1)  # graph input
# note: The radius at the corners of the internal parking islands.
in_island_corner_radius = DoubleSlider(1, range=0..5 step 0.1)  # graph input
# note: The width of the one way aisle.
in_one_way_aisle_width = DoubleSlider(4.4, range=4..10 step 0.1)  # graph input
# note: The width of the two way aisle.
in_two_way_aisle_width = DoubleSlider(5.4, range=4..10 step 0.1)  # graph input
# note: Establish the non-parking areas within the parking lot for landscaping by designating them as filled regions. These regions are spaces where parking will not be permitted.
in_select_green_zones = SelectFaces()  # 1 picked in the model; graph input
# note: Select lines to define the driving routes of the internal parking area.
in_select_axial_route_s = DSModelElementsByCategorySelection("OST_Lines")  # 2 picked in the model; graph input
# note: The width of the axial routes. 7000mm is set as the minimum.
in_axial_route_width = DoubleSlider(7, range=7..10 step 0.1)  # graph input
# note: Select the floor family type that will be used when the parking islands are loaded into the project.
in_select_island_floor_type = FloorTypes("Floor-Upper_160mmConc-CorusComFlor51")  # graph input
# note: The height of the parking islands above the selected parking level.
in_parking_island_height = DoubleSlider(0.1, range=0.1..0.2 step 0.01)  # graph input
# note: Select the family type that will be used when the parking spots are loaded into the project.
in_select_parking_family_type = FamilyTypes("Parking Bay:Parking Bay")  # graph input

# group: Project the site boundary onto the required level.
projectBoundaryOntoPlane = Custom[ProjectBoundaryOntoPlane](boundarySurface=in_select_parking_region, siteLevel=in_select_parking_level)  # package Feasibility; To project the boundaries developed from selected faces onto a plane.

# group: Create the internal and perimeter roadway surfaces.
internalandRoadwaySurfaces = Custom[InternalandRoadwaySurfaces](concaveCornerRadius=in_internal_turning_radius, convexCornerRadius=in_external_turning_radius, boundaryCurve=projectBoundaryOntoPlane.PolyCurve, bayLength=in_parking_bay_length, perimeterAisleWidth=in_perimeter_aisle_width)  # package Feasibility; Creates the internal parking and roadway surfaces.

# group: Project the green zone boundary onto the required level.
projectBoundaryOntoPlane_2 = Custom[ProjectBoundaryOntoPlane](boundarySurface=in_select_building_zones, siteLevel=in_select_parking_level)
byPatch = Surface.ByPatch(closedCurve=projectBoundaryOntoPlane_2.PolyCurve)

# group: Project the building zone boundary onto the required level.
projectBoundaryOntoPlane_3 = Custom[ProjectBoundaryOntoPlane](boundarySurface=in_select_building_zones, siteLevel=in_select_parking_level)

# group: Generate the perimeter parking spots.
byPatch_2 = Surface.ByPatch(closedCurve=projectBoundaryOntoPlane.PolyCurve)
getLevelPlane = Custom[GetLevelPlane](siteLevel=in_select_parking_level)  # package Feasibility; Get the plane from a selected Revit level.
join = List.Join(list0=projectBoundaryOntoPlane_3.PolyCurve, list1=projectBoundaryOntoPlane_2.PolyCurve)
byPatch_3 = Surface.ByPatch(closedCurve=join)
generatePerimeterSpots = Custom[GeneratePerimeterSpots](bayLength=in_parking_bay_length, boundarySurface=byPatch_2, convexCornerRadius=in_external_turning_radius, exclusionZoneAisleWidth=in_exclusion_zone_aisle_width, bayWidth=in_parking_bay_width, convexCornerSpacing=in_parking_bay_convex_corner, concaveCornerSpacing=in_parking_bay_concave_corner, basePlane=getLevelPlane, exclusionZone=byPatch_3)  # package Feasibility; Creates parking spots along the perimeter of the input boundary surface.

# group: Generate the exclusion zone perimeter parking spots.
exclusionZoneSpots = Custom[ExclusionZoneSpots](convexCornerRadius=in_external_turning_radius, perimeterRoadwaySurface=internalandRoadwaySurfaces.perimeterRoadwaySurface, internalParkingSurface=internalandRoadwaySurfaces.internalParkingSurface, convexCornerSpacing=in_parking_bay_convex_corner, concaveCornerSpacing=in_parking_bay_concave_corner, zoneParkingType=in_exclusion_area_parking_type, zoneWalkwayWidth=in_exclusion_zone_walkway_width, boundarySurface=byPatch_2, aisleWidth=in_perimeter_aisle_width, bayLength=in_parking_bay_length, bayWidth=in_parking_bay_width, exclusionZone=byPatch)  # package Feasibility; Create parking spots along the perimeter of the exclusion zones.

# group: Generate the bounding rectangle of the internal parking area.
generateBoundingRectangle = Custom[GenerateBoundingRectangle](degrees=in_bay_setout_line_rotation, closedCurve=internalandRoadwaySurfaces.internalBoundaryCurve)  # package Feasibility; Generates a rectangle around a planar closed curve, ensuring the curve is completely encapsulated.

# group: Generate the parking patterns.
generatePatterns = Custom[GeneratePatterns](patternAngle=in_parking_angle_selector, patternType=in_parking_pattern_selector, islandWidth=in_parking_island_width, internalRotation=in_bay_setout_line_rotation, bayWidth=in_parking_bay_width, bayLength=in_parking_bay_length, rectangleLength=generateBoundingRectangle.length)  # package Feasibility; Creates the parking patterns.

# group: Create projected exclusion zone surfaces.
# note: Combine the building and green zones into one list.
join_2 = List.Join(list0=in_select_building_zones, list1=in_select_green_zones)
projectBoundaryOntoPlane_4 = Custom[ProjectBoundaryOntoPlane](boundarySurface=join_2, siteLevel=in_select_parking_level)
byPatch_4 = Surface.ByPatch(closedCurve=projectBoundaryOntoPlane_4.PolyCurve)

# group: Project the axial route curves onto a plane.
curves = Element.Curves(element=in_select_axial_route_s)
projectRouteCurvesOntoPlane = Custom[ProjectRouteCurvesOntoPlane](axialRouteCurves=curves, siteLevel=in_select_parking_level)  # package Feasibility; To project selected route curves onto a Revit plane.

# group: Generate the internal parking spots.
internalBaysZonesRoutes = Custom[InternalBaysZonesRoutes](elongatedParkingPatterns=generatePatterns.elongatedParkingPatterns, greenAreaSurfaces=generatePatterns.greenAreaSurfaces, replacementElongatedPattern=generatePatterns.replacementElongatedPattern@L2, patternType=in_parking_pattern_selector, aisleTypeSelector=in_aisle_type_selector, patternAngle=in_parking_angle_selector, boundingRectangle=generateBoundingRectangle.Rectangle, patternWidth=generatePatterns.patternWidth, replacementPattern=generatePatterns.replacementPattern@L2, zoneParkingType=in_exclusion_area_parking_type, zoneWalkwayWidth=in_exclusion_zone_walkway_width, concaveCornerRadius=in_internal_turning_radius, islandCornerRadius=in_island_corner_radius, oneWayAisleWidth=in_one_way_aisle_width, twoWayAisleWidth=in_two_way_aisle_width, perimeterAisleWidth=in_perimeter_aisle_width, patternCenterLine=generatePatterns.patternCenterLine, parkingPattern=generatePatterns.parkingPattern, bayLength=in_parking_bay_length, perimeterCurves=generatePerimeterSpots.perimeterCurves, exclusionZone=byPatch_4, axialRouteCurves=projectRouteCurvesOntoPlane.projectedAxialRouteCurves, axialRouteWidth=in_axial_route_width, bayWidth=in_parking_bay_width, exclusionZoneAisleWidth=in_exclusion_zone_aisle_width, convexCornerRadius=in_external_turning_radius)  # package Feasibility; Creates internal parking bays and allows the delineation of movement routes within the parking layout.

# group: Colour the islands.
# note: Combine all the island surfaces into one list.
join_3 = List.Join(list0=exclusionZoneSpots.greenSurface, list1=generatePerimeterSpots.greenSurface, list2=internalBaysZonesRoutes.islandSurfaces, list3=byPatch)
code_block = CodeBlock { false; }
clean = List.Clean(list=join_3, preserveIndices=code_block)
flatten = List.Flatten(list=clean)
byJoinedSurfaces = PolySurface.ByJoinedSurfaces(surfaces=flatten)
code_block_2 = CodeBlock { Color.ByARGB(255,136,254,0); }
# note: Colour the islands.
byGeometryColor = Modifiers.GeometryColor.ByGeometryColor(geometry=byJoinedSurfaces, color=code_block_2)

# group: Create floors in Revit.
surfaces = PolySurface.Surfaces(polySurface=byJoinedSurfaces)
perimeterCurves = Surface.PerimeterCurves(surface=surfaces)
byJoinedCurves = PolyCurve.ByJoinedCurves(curves=perimeterCurves)
gate = Gate(false, byJoinedCurves)
byOutlineTypeAndLevel = Floor.ByOutlineTypeAndLevel(outlineCurves=gate, floorType=in_select_island_floor_type, level=in_select_parking_level)
code_block_3 = CodeBlock { "Height Offset From Level"; }
# note: Set the height of the parking island floors.
setParameterByName = Element.SetParameterByName(element=byOutlineTypeAndLevel, parameterName=code_block_3, value=in_parking_island_height)

# group: Colour the parking bays.
join_4 = List.Join(list0=exclusionZoneSpots.parkingSpots, list1=generatePerimeterSpots.parkingSpots, list2=internalBaysZonesRoutes.parkingSpots)
code_block_4 = CodeBlock { false; }
clean_2 = List.Clean(list=join_4, preserveIndices=code_block_4)
code_block_5 = CodeBlock { Color.ByARGB(255,0,0,255); }
# note: Colour the islands.
byGeometryColor_2 = Modifiers.GeometryColor.ByGeometryColor(geometry=clean_2, color=code_block_5)

# group: Place the parking bays in the Revit project.
# note: Combine all the parking bays into one list.
join_5 = List.Join(list0=exclusionZoneSpots.parkingSpots, list1=generatePerimeterSpots.parkingSpots, list2=internalBaysZonesRoutes.parkingSpots)
gate_2 = Gate(false, join_5)
flatten_2 = List.Flatten(list=gate_2)
# note: Get center of parking spots for parking bay placement.
center = Polygon.Center(polygon=flatten_2)
# note: Place parking bays in Revit project.
byPoint = FamilyInstance.ByPoint(familyType=in_select_parking_family_type, point=center)
# note: Combine all the parking bay rotation angles into one list.
join_6 = List.Join(list0=exclusionZoneSpots.rotationAngle, list1=generatePerimeterSpots.rotationAngle, list2=internalBaysZonesRoutes.rotationAngle)
flatten_3 = List.Flatten(list=join_6)
# note: Rotate the parking bays.
setRotation = FamilyInstance.SetRotation(familyInstance=byPoint@L1, degree=flatten_3@L1)

# group: Set the parking bay width and length parameters.
code_block_6 = CodeBlock { "Parking_Bay Length"; }
# note: Set the length of the parking bays in the Revit project.
setParameterByName_2 = Element.SetParameterByName(element=setRotation, parameterName=code_block_6, value=in_parking_bay_length)
code_block_7 = CodeBlock { "Parking_Bay Width"; }
width = Rectangle.Width(rectangle=exclusionZoneSpots.parkingSpots)
width_2 = Rectangle.Width(rectangle=generatePerimeterSpots.parkingSpots)
height = Rectangle.Height(rectangle=internalBaysZonesRoutes.parkingSpots)
# note: Combine all the parking bay widths into one list.
join_7 = List.Join(list0=width, list1=width_2, list2=height)
flatten_4 = List.Flatten(list=join_7)
# note: Set the width of the parking bays in the Revit project.
setParameterByName_3 = Element.SetParameterByName(element=setRotation@L1, parameterName=code_block_7, value=flatten_4@L1)
width_3 = Rectangle.Width(rectangle=exclusionZoneSpots.parkingSpots)

# group: Total area occupied by the parking spots.
height_2 = Rectangle.Height(rectangle=join_4)
flatten_5 = List.Flatten(list=height_2)
width_4 = Rectangle.Width(rectangle=join_4)
flatten_6 = List.Flatten(list=width_4)
code_block_8 = CodeBlock(height=flatten_5, width=flatten_6) { height * width; }
sum = Math.Sum(values=code_block_8)
ceiling = Math.Ceiling(number=sum)
out_parking_total_area = Watch(ceiling)  # graph output

# group: Site area.
# note: Site Area
area = Surface.Area(surface=byPatch_2)
ceiling_2 = Math.Ceiling(number=area)
code_block_9 = CodeBlock { 0; }
getItemAtIndex = List.GetItemAtIndex(list=ceiling_2, index=code_block_9)
out_site_area = Watch(getItemAtIndex)  # graph output

# group: Percentage of parking site occupied by the parking spots.
code_block_10 = CodeBlock(parkingArea=out_parking_total_area, siteArea=out_site_area)
# ---------- code_block_10.designscript (2 lines) ----------
// Calculate percentage space occupied by the parking spots.
parkingAreaPercent = (parkingArea / siteArea) *100;
# ----------------------------------------
ceiling_3 = Math.Ceiling(number=code_block_10)
out_parking_area_percentage = Watch(ceiling_3)  # graph output

# group: Total area occupied by the islands.
area_2 = Surface.Area(surface=flatten)
sum_2 = Math.Sum(values=area_2)
ceiling_4 = Math.Ceiling(number=sum_2)
out_island_total_area = Watch(ceiling_4)  # graph output

# group: Total area of the movement roadways.
code_block_11 = CodeBlock(siteArea=out_site_area, parkingArea=out_parking_total_area, islandArea=out_island_total_area)
# ---------- code_block_11.designscript (2 lines) ----------
// Calculate the roadway area.
roadWayArea = siteArea - (parkingArea + islandArea);
# ----------------------------------------
out_roadway_total_area = Watch(code_block_11)  # graph output

# group: Percentage of parking site occupied by the roadways.
code_block_12 = CodeBlock(roadWayArea=out_roadway_total_area, siteArea=out_site_area)
# ---------- code_block_12.designscript (2 lines) ----------
// Calculate percentage space occupied by the roadways.
roadWayAreaPercent = (roadWayArea / siteArea) *100;
# ----------------------------------------
ceiling_5 = Math.Ceiling(number=code_block_12)
out_roadway_area_percentage = Watch(ceiling_5)  # graph output

# group: Percentage of parking site occupied by the islands.
code_block_13 = CodeBlock(islandArea=out_island_total_area, siteArea=out_site_area)
# ---------- code_block_13.designscript (2 lines) ----------
// Calculate percentage space occupied by the islands.
islandAreaPercent = (islandArea / siteArea) *100;
# ----------------------------------------
ceiling_6 = Math.Ceiling(number=code_block_13)
out_island_area_percentage = Watch(ceiling_6)  # graph output

# group: Represent the parking, road way, and island areas in a pie chart.
# note: Combine the parking, roadway, and island areas.
code_block_14 = CodeBlock(parkingArea=out_parking_area_percentage, roadWayArea=out_roadway_area_percentage, islandArea=out_island_area_percentage)
# ---------- code_block_14.designscript (8 lines) ----------
//Create inputs for the presentation of the areas in a pie chart.
labels = ["Parking", "Road Way", "Island"];
areas = [parkingArea, roadWayArea, islandArea];
colors = [
		Color.ByARGB(255, 255, 0, 0),
		Color.ByARGB(255, 0, 255, 0),
		Color.ByARGB(255, 0, 0, 255)
		];
# ----------------------------------------
pie_chart = PieChartNodeModel(labels=code_block_14.labels, values=code_block_14.areas, colors=code_block_14.colors, Labels=["Parking", "Road Way", "Island"], Values=[39, 50, 12], Colors=["#FFFF0000", "#FF00FF00", "#FF0000FF"])  # graph output

# group: Parking spot count.
count = List.Count(list=code_block_8)
out_parking_spot_number = Watch(count)  # graph output
