# Dynamo graph Scenario 3_perimeter_internal_routes.dyn (Dynamo 3.3.0.6316)
# packages: Feasibility 2025.8.11

# group: Inputs
# note: The length of the parking bays.
in_parking_bay_length = DoubleSlider(5, range=0.5..10 step 0.1)  # graph input
# note: Define the parking region with a filled region.
in_select_parking_region = DSFaceSelection()  # 1 picked in the model; graph input
# note: Select the level to host the parking bays.
in_select_parking_level = Levels("Level 0")  # graph input
# note: The vehicle turning radius at the convex corners of the perimeter aisle.
in_external_turning_radius = DoubleSlider(5, range=5..10 step 0.1)  # graph input
# note: The width of the parking bays.
in_parking_bay_width = DoubleSlider(2.5, range=0.5..5 step 0.1)  # graph input
# note: The distance between the parking bays at the convex corners.
in_parking_bay_convex_corner = DoubleSlider(2, range=0.3..5 step 0.1)  # "IN_Parking Bay Convex Corner Spacing"; graph input
# note: The distance between the parking bays at the concave corners.
in_parking_bay_concave_corner = DoubleSlider(0.5, range=0.5..10 step 0.1)  # "IN_Parking Bay Concave Corner Spacing"; graph input
# note: Select "1" for 45 degree parking, "2" for 60 degree parking, and "3" for 90 degree parking. Note that the angles are not applied to the perimeter parking bays and herringbone pattern. The herringbone pattern will always be at 45 degrees.
in_parking_angle_selector = IntegerSlider(4, range=1..4 step 1)  # graph input
# note: Select "1" for the non interlocking pattern which allows for an island between the bay rows, "2" for the interlocking pattern, "3" for the mirrored interlocking pattern, and "4" for the herringbone pattern.
in_parking_pattern_selector = IntegerSlider(3, range=1..4 step 1)  # graph input
# note: The width of the island between the non interlocking parking pattern.
in_parking_island_width = DoubleSlider(1, range=0.5..2 step 0.1)  # graph input
# note: The rotation angle of the setout line of the center bays.
in_bay_setout_line_rotation = DoubleSlider(0, range=0..360 step 1)  # graph input
# note: The vehicle turning radius at the concave corners of the perimeter aisle.
in_internal_turning_radius = DoubleSlider(3.5, range=3.5..10 step 0.1)  # graph input
# note: The width of the perimeter aisle for the overall parking layout.
in_perimeter_aisle_width = DoubleSlider(7, range=7..10 step 0.1)  # graph input
# note: Select "1" for one way traffic, and "2" for two way traffic.
in_aisle_type_selector = IntegerSlider(2, range=1..2 step 1)  # graph input
# note: The radius at the corners of the internal parking islands.
in_island_corner_radius = DoubleSlider(1, range=0..5 step 0.1)  # graph input
# note: The width of the one way aisle.
in_one_way_aisle_width = DoubleSlider(4.4, range=4..10 step 0.1)  # graph input
# note: The width of the two way aisle.
in_two_way_aisle_width = DoubleSlider(5.4, range=4..10 step 0.1)  # graph input
# note: Select lines to define the driving routes of the internal parking area.
in_select_axial_route_s = DSModelElementsByCategorySelection("OST_Lines")  # 2 picked in the model; graph input
# note: The width of the axial routes. 7000mm is set as the minimum.
in_axial_route_width = DoubleSlider(7, range=7..10 step 0.1)  # graph input
# note: Select the floor family type that will be used when the parking islands are loaded into the project.
in_select_island_floor_type = FloorTypes("Floor-Upper_160mmConc-CorusComFlor51")  # graph input
# note: The height of the parking islands above the selected parking level.
in_parking_island_height = DoubleSlider(0.1, range=0.1..0.2 step 0.01)  # graph input
# note: Select the family type that will be used when the parking spots are loaded into the project.
in_select_parking_family_type = FamilyTypes("Parking Bay:Parking Bay")  # graph input

# group: Project the site boundary onto the required level.
projectBoundaryOntoPlane = Custom[ProjectBoundaryOntoPlane](boundarySurface=in_select_parking_region, siteLevel=in_select_parking_level)  # package Feasibility; To project the boundaries developed from selected faces onto a plane.

# group: Generate the perimeter parking spots.
byPatch = Surface.ByPatch(closedCurve=projectBoundaryOntoPlane.PolyCurve)
getLevelPlane = Custom[GetLevelPlane](siteLevel=in_select_parking_level)  # package Feasibility; Get the plane from a selected Revit level.
origin = Plane.Origin(plane=getLevelPlane)
Z = Point.Z(point=origin)
code_block = CodeBlock(z=Z) { z+1; }
byCoordinates = Point.ByCoordinates(z=code_block)
code_block_2 = CodeBlock { Vector.ZAxis(); }
byOriginNormal = Plane.ByOriginNormal(origin=byCoordinates, normal=code_block_2)
byWidthLength = Rectangle.ByWidthLength(plane=byOriginNormal)
# note: Create a surface that does not intersect the parking level to fill the "exclusionZone" input.
byPatch_2 = Surface.ByPatch(closedCurve=byWidthLength)
generatePerimeterSpots = Custom[GeneratePerimeterSpots](bayLength=in_parking_bay_length, boundarySurface=byPatch, convexCornerRadius=in_external_turning_radius, bayWidth=in_parking_bay_width, convexCornerSpacing=in_parking_bay_convex_corner, concaveCornerSpacing=in_parking_bay_concave_corner, basePlane=getLevelPlane, exclusionZone=byPatch_2)  # package Feasibility; Creates parking spots along the perimeter of the input boundary surface.

# group: Create the internal and perimeter roadway surfaces.
internalandRoadwaySurfaces = Custom[InternalandRoadwaySurfaces](concaveCornerRadius=in_internal_turning_radius, convexCornerRadius=in_external_turning_radius, boundaryCurve=projectBoundaryOntoPlane.PolyCurve, bayLength=in_parking_bay_length, perimeterAisleWidth=in_perimeter_aisle_width)  # package Feasibility; Creates the internal parking and roadway surfaces.

# group: Generate the bounding rectangle of the internal parking area.
generateBoundingRectangle = Custom[GenerateBoundingRectangle](degrees=in_bay_setout_line_rotation, closedCurve=internalandRoadwaySurfaces.internalBoundaryCurve)  # package Feasibility; Generates a rectangle around a planar closed curve, ensuring the curve is completely encapsulated.

# group: Generate the parking patterns.
generatePatterns = Custom[GeneratePatterns](patternAngle=in_parking_angle_selector, patternType=in_parking_pattern_selector, islandWidth=in_parking_island_width, internalRotation=in_bay_setout_line_rotation, bayWidth=in_parking_bay_width, bayLength=in_parking_bay_length, rectangleLength=generateBoundingRectangle.length)  # package Feasibility; Creates the parking patterns.

# group: Project the axial route curves onto a plane.
curves = Element.Curves(element=in_select_axial_route_s)
projectRouteCurvesOntoPlane = Custom[ProjectRouteCurvesOntoPlane](axialRouteCurves=curves, siteLevel=in_select_parking_level)  # package Feasibility; To project selected route curves onto a Revit plane.

# group: Generate the internal parking spots.
internalBaysRoutes = Custom[InternalBaysRoutes](elongatedParkingPatterns=generatePatterns.elongatedParkingPatterns, greenAreaSurfaces=generatePatterns.greenAreaSurfaces, replacementElongatedPattern=generatePatterns.replacementElongatedPattern@L2, patternType=in_parking_pattern_selector, aisleTypeSelector=in_aisle_type_selector, patternAngle=in_parking_angle_selector, boundingRectangle=generateBoundingRectangle.Rectangle, patternWidth=generatePatterns.patternWidth, replacementPattern=generatePatterns.replacementPattern@L2, concaveCornerRadius=in_internal_turning_radius, convexCornerRadius=in_external_turning_radius, islandCornerRadius=in_island_corner_radius, oneWayAisleWidth=in_one_way_aisle_width, twoWayAisleWidth=in_two_way_aisle_width, perimeterAisleWidth=in_perimeter_aisle_width, patternCenterLine=generatePatterns.patternCenterLine, parkingPattern=generatePatterns.parkingPattern, perimeterCurves=generatePerimeterSpots.perimeterCurves, axialRouteCurves=projectRouteCurvesOntoPlane.projectedAxialRouteCurves, axialRouteWidth=in_axial_route_width, bayLength=in_parking_bay_length)  # package Feasibility; Creates internal parking bays and allows the delineation of movement routes within the parking layout.

# group: Colour the islands.
# note: Combine all the island surfaces into one list.
join = List.Join(list0=generatePerimeterSpots.greenSurface, list1=internalBaysRoutes.islandSurfaces)
code_block_3 = CodeBlock { false; }
clean = List.Clean(list=join, preserveIndices=code_block_3)
flatten = List.Flatten(list=clean)
byJoinedSurfaces = PolySurface.ByJoinedSurfaces(surfaces=flatten)
code_block_4 = CodeBlock { Color.ByARGB(255,136,254,0); }
# note: Colour the islands.
byGeometryColor = Modifiers.GeometryColor.ByGeometryColor(geometry=byJoinedSurfaces, color=code_block_4)

# group: Create floors in Revit.
surfaces = PolySurface.Surfaces(polySurface=byJoinedSurfaces)
perimeterCurves = Surface.PerimeterCurves(surface=surfaces)
byJoinedCurves = PolyCurve.ByJoinedCurves(curves=perimeterCurves)
gate = Gate(false, byJoinedCurves)
byOutlineTypeAndLevel = Floor.ByOutlineTypeAndLevel(outlineCurves=gate, floorType=in_select_island_floor_type, level=in_select_parking_level)
code_block_5 = CodeBlock { "Height Offset From Level"; }
# note: Set the height of the parking island floors.
setParameterByName = Element.SetParameterByName(element=byOutlineTypeAndLevel, parameterName=code_block_5, value=in_parking_island_height)

# group: Colour the parking bays.
join_2 = List.Join(list0=generatePerimeterSpots.parkingSpots, list1=internalBaysRoutes.parkingSpots)
code_block_6 = CodeBlock { false; }
clean_2 = List.Clean(list=join_2, preserveIndices=code_block_6)
code_block_7 = CodeBlock { Color.ByARGB(255,0,0,255); }
# note: Colour the islands.
byGeometryColor_2 = Modifiers.GeometryColor.ByGeometryColor(geometry=clean_2, color=code_block_7)

# group: Place the parking bays in the Revit project.
# note: Combine all the parking bays into one list.
join_3 = List.Join(list0=generatePerimeterSpots.parkingSpots, list1=internalBaysRoutes.parkingSpots)
gate_2 = Gate(false, join_3)
flatten_2 = List.Flatten(list=gate_2)
# note: Get center of parking spots for parking bay placement.
center = Polygon.Center(polygon=flatten_2)
# note: Place parking bays in Revit project.
byPoint = FamilyInstance.ByPoint(familyType=in_select_parking_family_type, point=center)
# note: Combine all the parking bay rotation angles into one list.
join_4 = List.Join(list0=generatePerimeterSpots.rotationAngle, list1=internalBaysRoutes.rotationAngle)
flatten_3 = List.Flatten(list=join_4)
# note: Rotate the parking bays.
setRotation = FamilyInstance.SetRotation(familyInstance=byPoint@L1, degree=flatten_3@L1)

# group: Set the parking bay width and length parameters.
code_block_8 = CodeBlock { "Parking_Bay Length"; }
# note: Set the length of the parking bays in the Revit project.
setParameterByName_2 = Element.SetParameterByName(element=setRotation, parameterName=code_block_8, value=in_parking_bay_length)
code_block_9 = CodeBlock { "Parking_Bay Width"; }
width = Rectangle.Width(rectangle=generatePerimeterSpots.parkingSpots)
height = Rectangle.Height(rectangle=internalBaysRoutes.parkingSpots)
# note: Combine all the parking bay widths into one list.
join_5 = List.Join(list0=width, list1=height)
flatten_4 = List.Flatten(list=join_5)
# note: Set the width of the parking bays in the Revit project.
setParameterByName_3 = Element.SetParameterByName(element=setRotation@L1, parameterName=code_block_9, value=flatten_4@L1)

# group: Total area occupied by the parking spots.
height_2 = Rectangle.Height(rectangle=join_2)
flatten_5 = List.Flatten(list=height_2)
width_2 = Rectangle.Width(rectangle=join_2)
flatten_6 = List.Flatten(list=width_2)
code_block_10 = CodeBlock(height=flatten_5, width=flatten_6) { height * width; }
sum = Math.Sum(values=code_block_10)
ceiling = Math.Ceiling(number=sum)
out_parking_total_area = Watch(ceiling)  # graph output

# group: Site area.
# note: Site Area
area = Surface.Area(surface=byPatch)
ceiling_2 = Math.Ceiling(number=area)
code_block_11 = CodeBlock { 0; }
getItemAtIndex = List.GetItemAtIndex(list=ceiling_2, index=code_block_11)
out_site_area = Watch(getItemAtIndex)  # graph output

# group: Percentage of parking site occupied by the parking spots.
code_block_12 = CodeBlock(parkingArea=out_parking_total_area, siteArea=out_site_area)
# ---------- code_block_12.designscript (2 lines) ----------
// Calculate percentage space occupied by the parking spots.
parkingAreaPercent = (parkingArea / siteArea) *100;
# ----------------------------------------
ceiling_3 = Math.Ceiling(number=code_block_12)
out_parking_area_percentage = Watch(ceiling_3)  # graph output

# group: Total area occupied by the islands.
area_2 = Surface.Area(surface=flatten)
sum_2 = Math.Sum(values=area_2)
ceiling_4 = Math.Ceiling(number=sum_2)
out_island_total_area = Watch(ceiling_4)  # graph output

# group: Total area of the movement roadways.
code_block_13 = CodeBlock(siteArea=out_site_area, parkingArea=out_parking_total_area, islandArea=out_island_total_area)
# ---------- code_block_13.designscript (2 lines) ----------
// Calculate the roadway area.
roadWayArea = siteArea - (parkingArea + islandArea);
# ----------------------------------------
out_roadway_total_area = Watch(code_block_13)  # graph output

# group: Percentage of parking site occupied by the roadways.
code_block_14 = CodeBlock(roadWayArea=out_roadway_total_area, siteArea=out_site_area)
# ---------- code_block_14.designscript (2 lines) ----------
// Calculate percentage space occupied by the roadways.
roadWayAreaPercent = (roadWayArea / siteArea) *100;
# ----------------------------------------
ceiling_5 = Math.Ceiling(number=code_block_14)
out_roadway_area_percentage = Watch(ceiling_5)  # graph output

# group: Percentage of parking site occupied by the islands.
code_block_15 = CodeBlock(islandArea=out_island_total_area, siteArea=out_site_area)
# ---------- code_block_15.designscript (2 lines) ----------
// Calculate percentage space occupied by the islands.
islandAreaPercent = (islandArea / siteArea) *100;
# ----------------------------------------
ceiling_6 = Math.Ceiling(number=code_block_15)
out_island_area_percentage = Watch(ceiling_6)  # graph output

# group: Represent the parking, road way, and island areas in a pie chart.
# note: Combine the parking, roadway, and island areas.
code_block_16 = CodeBlock(parkingArea=out_parking_area_percentage, roadWayArea=out_roadway_area_percentage, islandArea=out_island_area_percentage)
# ---------- code_block_16.designscript (8 lines) ----------
//Create inputs for the presentation of the areas in a pie chart.
labels = ["Parking", "Road Way", "Island"];
areas = [parkingArea, roadWayArea, islandArea];
colors = [
		Color.ByARGB(255, 255, 0, 0),
		Color.ByARGB(255, 0, 255, 0),
		Color.ByARGB(255, 0, 0, 255)
		];
# ----------------------------------------
pie_chart = PieChartNodeModel(labels=code_block_16.labels, values=code_block_16.areas, colors=code_block_16.colors, Labels=["Parking", "Road Way", "Island"], Values=[44, 50, 7], Colors=["#FFFF0000", "#FF00FF00", "#FF0000FF"])  # graph output

# group: Parking spot count.
count = List.Count(list=code_block_10)
out_parking_spot_number = Watch(count)  # graph output
