# Dynamo graph Scenario 7_Internal_routes.dyn (Dynamo 3.3.0.6316)
# packages: Feasibility 2025.8.11

# group: Inputs
# note: Select "1" for 45 degree parking, "2" for 60 degree parking, and "3" for 90 degree parking. Note that the angles are not applied to the perimeter parking bays and herringbone pattern. The herringbone pattern will always be at 45 degrees.
in_parking_angle_selector = IntegerSlider(4, range=1..4 step 1)  # graph input
# note: Select "1" for the non interlocking pattern which allows for an island between the bay rows, "2" for the interlocking pattern, "3" for the mirrored interlocking pattern, and "4" for the herringbone pattern.
in_parking_pattern_selector = IntegerSlider(3, range=1..4 step 1)  # graph input
# note: The width of the island between the non interlocking parking pattern.
in_parking_island_width = DoubleSlider(1, range=0.5..2 step 0.1)  # graph input
# note: The rotation angle of the setout line of the center bays.
in_bay_setout_line_rotation = DoubleSlider(0, range=0..360 step 1)  # graph input
# note: The width of the parking bays.
in_parking_bay_width = DoubleSlider(2.5, range=0.5..5 step 0.1)  # graph input
# note: The length of the parking bays.
in_parking_bay_length = DoubleSlider(5, range=0.5..10 step 0.1)  # graph input
# note: The vehicle turning radius at the concave corners of the perimeter aisle.
in_internal_turning_radius = DoubleSlider(3.5, range=3.5..10 step 0.1)  # graph input
# note: The vehicle turning radius at the convex corners of the perimeter aisle.
in_external_turning_radius = DoubleSlider(5, range=5..10 step 0.1)  # graph input
# note: Define the parking region with a filled region.
in_select_parking_region = DSFaceSelection()  # 1 picked in the model; graph input
# note: Select the level to host the parking bays.
in_select_parking_level = Levels("Level 0")  # graph input
# note: The width of the perimeter aisle for the overall parking layout.
in_perimeter_aisle_width = DoubleSlider(7, range=7..10 step 0.1)  # graph input
# note: Select "1" for one way traffic, and "2" for two way traffic.
in_aisle_type_selector = IntegerSlider(1, range=1..2 step 1)  # graph input
# note: The radius at the corners of the internal parking islands.
in_island_corner_radius = DoubleSlider(1, range=0..5 step 0.1)  # graph input
# note: The width of the one way aisle.
in_one_way_aisle_width = DoubleSlider(4.4, range=4..10 step 0.1)  # graph input
# note: The width of the two way aisle.
in_two_way_aisle_width = DoubleSlider(5.4, range=4..10 step 0.1)  # graph input
# note: Select lines to define the driving routes of the internal parking area.
in_select_axial_route_s = DSModelElementsByCategorySelection("OST_Lines")  # 2 picked in the model; graph input
# note: The width of the axial routes. 7000mm is set as the minimum.
in_axial_route_width = DoubleSlider(7, range=7..10 step 0.1)  # graph input
# note: Select the floor family type that will be used when the parking islands are loaded into the project.
in_select_island_floor_type = FloorTypes("Floor-Upper_160mmConc-CorusComFlor51")  # graph input
# note: The height of the parking islands above the selected parking level.
in_parking_island_height = DoubleSlider(0.1, range=0.1..0.2 step 0.01)  # graph input
# note: Select the family type that will be used when the parking spots are loaded into the project.
in_select_parking_family_type = FamilyTypes("Parking Bay:Parking Bay")  # graph input

# group: Project the site boundary onto the required level.
projectBoundaryOntoPlane = Custom[ProjectBoundaryOntoPlane](boundarySurface=in_select_parking_region, siteLevel=in_select_parking_level)  # package Feasibility; To project the boundaries developed from selected faces onto a plane.

# group: Create the internal and perimeter roadway surfaces.
internalandRoadwaySurfaces = Custom[InternalandRoadwaySurfaces](concaveCornerRadius=in_internal_turning_radius, convexCornerRadius=in_external_turning_radius, boundaryCurve=projectBoundaryOntoPlane.PolyCurve, bayLength=in_parking_bay_length, perimeterAisleWidth=in_perimeter_aisle_width)  # package Feasibility; Creates the internal parking and roadway surfaces.

# group: Generate the bounding rectangle of the internal parking area.
generateBoundingRectangle = Custom[GenerateBoundingRectangle](degrees=in_bay_setout_line_rotation, closedCurve=internalandRoadwaySurfaces.internalBoundaryCurve)  # package Feasibility; Generates a rectangle around a planar closed curve, ensuring the curve is completely encapsulated.

# group: Generate the parking patterns.
generatePatterns = Custom[GeneratePatterns](patternAngle=in_parking_angle_selector, patternType=in_parking_pattern_selector, islandWidth=in_parking_island_width, internalRotation=in_bay_setout_line_rotation, bayWidth=in_parking_bay_width, bayLength=in_parking_bay_length, rectangleLength=generateBoundingRectangle.length)  # package Feasibility; Creates the parking patterns.

# group: Get the perimeter curves of the site surface.
byPatch = Surface.ByPatch(closedCurve=projectBoundaryOntoPlane.PolyCurve)
perimeterCurves = Surface.PerimeterCurves(surface=byPatch)

# group: Project the axial route curves onto a plane.
curves = Element.Curves(element=in_select_axial_route_s)
projectRouteCurvesOntoPlane = Custom[ProjectRouteCurvesOntoPlane](axialRouteCurves=curves, siteLevel=in_select_parking_level)  # package Feasibility; To project selected route curves onto a Revit plane.

# group: Generate the internal parking spots.
internalBaysRoutes = Custom[InternalBaysRoutes](elongatedParkingPatterns=generatePatterns.elongatedParkingPatterns, greenAreaSurfaces=generatePatterns.greenAreaSurfaces, replacementElongatedPattern=generatePatterns.replacementElongatedPattern@L2, patternType=in_parking_pattern_selector, aisleTypeSelector=in_aisle_type_selector, patternAngle=in_parking_angle_selector, boundingRectangle=generateBoundingRectangle.Rectangle, patternWidth=generatePatterns.patternWidth, replacementPattern=generatePatterns.replacementPattern@L2, concaveCornerRadius=in_internal_turning_radius, convexCornerRadius=in_external_turning_radius, islandCornerRadius=in_island_corner_radius, oneWayAisleWidth=in_one_way_aisle_width, twoWayAisleWidth=in_two_way_aisle_width, perimeterAisleWidth=in_perimeter_aisle_width, patternCenterLine=generatePatterns.patternCenterLine, parkingPattern=generatePatterns.parkingPattern, perimeterCurves=perimeterCurves, axialRouteCurves=projectRouteCurvesOntoPlane.projectedAxialRouteCurves, axialRouteWidth=in_axial_route_width, bayLength=in_parking_bay_length)  # package Feasibility; Creates internal parking bays and allows the delineation of movement routes within the parking layout.

# group: Colour the islands.
code_block = CodeBlock { false; }
clean = List.Clean(list=internalBaysRoutes.islandSurfaces, preserveIndices=code_block)
flatten = List.Flatten(list=clean)
byJoinedSurfaces = PolySurface.ByJoinedSurfaces(surfaces=flatten)
code_block_2 = CodeBlock { Color.ByARGB(255,136,254,0); }
# note: Colour the islands.
byGeometryColor = Modifiers.GeometryColor.ByGeometryColor(geometry=byJoinedSurfaces, color=code_block_2)

# group: Create floors in Revit.
surfaces = PolySurface.Surfaces(polySurface=byJoinedSurfaces)
perimeterCurves_2 = Surface.PerimeterCurves(surface=surfaces)
byJoinedCurves = PolyCurve.ByJoinedCurves(curves=perimeterCurves_2)
gate = Gate(false, byJoinedCurves)
byOutlineTypeAndLevel = Floor.ByOutlineTypeAndLevel(outlineCurves=gate, floorType=in_select_island_floor_type, level=in_select_parking_level)
code_block_3 = CodeBlock { "Height Offset From Level"; }
# note: Set the height of the parking island floors.
setParameterByName = Element.SetParameterByName(element=byOutlineTypeAndLevel, parameterName=code_block_3, value=in_parking_island_height)

# group: Colour the parking bays.
code_block_4 = CodeBlock { false; }
clean_2 = List.Clean(list=internalBaysRoutes.parkingSpots, preserveIndices=code_block_4)
code_block_5 = CodeBlock { Color.ByARGB(255,0,0,255); }
# note: Colour the islands.
byGeometryColor_2 = Modifiers.GeometryColor.ByGeometryColor(geometry=clean_2, color=code_block_5)

# group: Place the parking bays in the Revit project.
# note: Combine all the parking bays into one list.
join = List.Join(list0=internalBaysRoutes.parkingSpots)
gate_2 = Gate(false, join)
flatten_2 = List.Flatten(list=gate_2)
# note: Get center of parking spots for parking bay placement.
center = Polygon.Center(polygon=flatten_2)
# note: Place parking bays in Revit project.
byPoint = FamilyInstance.ByPoint(familyType=in_select_parking_family_type, point=center)
flatten_3 = List.Flatten(list=internalBaysRoutes.rotationAngle)
# note: Rotate the parking bays.
setRotation = FamilyInstance.SetRotation(familyInstance=byPoint@L1, degree=flatten_3@L1)

# group: Set the parking bay width and length parameters.
code_block_6 = CodeBlock { "Parking_Bay Length"; }
# note: Set the length of the parking bays in the Revit project.
setParameterByName_2 = Element.SetParameterByName(element=setRotation, parameterName=code_block_6, value=in_parking_bay_length)
code_block_7 = CodeBlock { "Parking_Bay Width"; }
height = Rectangle.Height(rectangle=internalBaysRoutes.parkingSpots)
flatten_4 = List.Flatten(list=height)
# note: Set the width of the parking bays in the Revit project.
setParameterByName_3 = Element.SetParameterByName(element=setRotation@L1, parameterName=code_block_7, value=flatten_4@L1)
