# Dynamo graph parking-symbols.dyn (Dynamo 2.18.1.5096)

# group: Export JSON File
file_path = Filename("..\layouts\curvedLayout.json")
select_face = DSFaceSelection()  # 1 picked in the model
toSolidDef = Geometry.ToSolidDef(geometry=select_face)
stringifyJSON = Data.StringifyJSON(values=toSolidDef, lacing=CrossProduct)
writeText = FileSystem.WriteText(filePath=file_path, text=stringifyJSON, lacing=Longest)
select_faces = SelectFaces()  # 1 picked in the model
